# Grasshopper definition 02_masonry_assembly_color_order.gh (Grasshopper 1.0.8)
# plug-ins: Frahan StonePack

dtol = Slider(0.023, range=0..0.1)
atol = Slider(8.511, range=0..50)
ids = BlockIds(["B0", "B1", "B2", "B3", "B4"])
# README: EX 02 MASONRY ASSEMBLY
# Blocks -> contacts -> assembly -> build order -> RBE stability.
# 1. Solve runs automatically (5 internalized blocks).
# 2. Colours = build order (blue first, red last).
# 3. Flip 'Run RBE' toggle for the stability verdict panel.
M = M([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])
autoif = AutoInterfaces(Meshes=M, BlockIds=ids, DistanceTolerance=dtol, AngleToleranceDeg=atol)
masblk = MasonryBlock(Mesh=M, Id=ids, Density=2400)  # -> Block, Id
fix = FixedIds("B0")
masasm = MasonryAssembly(Blocks=masblk.Block, Interfaces=autoif, FixedBlockIds=fix)
run_rbe = BooleanToggle(True)
masrbe = MasonryStabilityRBE(Assembly=masasm, Mu=0.84, Faces=4, Penalty=False, Run=run_rbe)  # -> Verdict, Objective, ResidualNorm, SolverName, Report
buildord = BlockBuildOrder(Assembly=masasm, UpVector=Vector(0, 0, 1), UpToleranceDeg=30)  # -> OrderedBlockIds, OrderedMeshes, OrderIndex, Layer
gradient = Gradient(
    LowerLimit=0,
    UpperLimit=4,
    Parameter=buildord.OrderIndex,
    stops=[0.0378: RGB(234, 38, 0), 0.244: RGB(234, 126, 0), 0.475: RGB(254, 244, 84), 0.75: RGB(173, 203, 249), 1: RGB(75, 107, 169)])
report = Panel(masrbe.Report)
verdict = Panel(masrbe.Verdict)
asmprev = AssemblyPreview(Assembly=masasm)  # -> FreeMeshes, FixedMeshes, FreeBlockIds, FixedBlockIds, ContactPolylines, ContactCentroids, ContactNormals, ContactPairs
preview = CustomPreview(Geometry=buildord.OrderedMeshes, Material=gradient)
