# Grasshopper definition 03_quarry_to_slabs_full.gh (Grasshopper 1.0.8)
# plug-ins: Frahan StonePack

# README: EX 03 QUARRY TO SLABS
# Same BlockCutOpt engine tuned for thin slabs.
# 1. Lz slider = slab thickness, Kerf = saw loss (m).
# 2. Flip Run=True to solve.
# 3. Panels: recovery % / slab count.
# Red mesh = fracture planes.
swatch = ColourSwatch(SwatchColor=RGB(200, 60, 40))
A = TestedArea({Plane=PlaneXY(0, 0, 0), X=Domain(0, 12), Y=Domain(0, 8), Z=Domain(0, 6)})
F = Fractures(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)
preview = CustomPreview(Geometry=F, Material=swatch)
lx = Slider(3, range=1..5)
ly = Slider(2, range=1..4)
lz = Slider(0.05, range=0.02..0.5)
kerf = Slider(0.01, range=0..0.05)
run = BooleanToggle(False)
blockcutsolve = BlockCutOptSolve(
    TestedArea=A,
    Fractures=F,
    BlockX=lx,
    BlockY=ly,
    BlockZ=lz,
    Kerf=kerf,
    PsiStepDeg=3,
    DxMax=1.5,
    DxStep=0.5,
    DyMax=1.5,
    DyStep=0.5,
    Run=run)  # -> NonIntersectedCount, Recovery, BestPsiDeg, BestDxM, BestDyM, Evaluations, ElapsedMs
recovery = Panel(blockcutsolve.Recovery)
blocks = Panel(blockcutsolve.NonIntersectedCount)
