# Grasshopper definition 04_scan_to_bench.gh (Grasshopper 1.0.8)
# plug-ins: Frahan StonePack

# README: EX 04 SCAN TO BENCH
# Cloud -> normals -> Poisson reconstruct -> bench box for block planning.
# Set the cloud path, then flip Run toggles in order.
pc = PC(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)
V = Slider(0.25, range=0..1)
k = Slider(0.25, range=0..1)
A = Slider(0.626, range=0..1)
voxeldown = VoxelDownsample(VoxelSize=V, Geometry=pc)  # -> Downsampled, ReductionFactor, OutputCount, Cloud
run_normals = BooleanToggle(True)
estnormals = EstimateCloudNormals(Points=voxeldown.Downsampled, KNeighbours=18, Cloud=voxeldown.Cloud, Run=run_normals)  # -> Normals, Report, Cloud
scanrecon = ScanReconstruct(
    Points=voxeldown.Downsampled,
    Normals=estnormals.Normals,
    Mode=Slider(3, range=0..10),
    Alpha=A,
    PoissonDepth=8,
    SamplesPerNode=1.5,
    RadiusRatio=5,
    AFBeta=0.52,
    Cloud=estnormals.Cloud,
    Run=Toggle(True))  # -> Mesh, UsedMode, Report
recon_styled = CustomPreview(
    Geometry=scanrecon.Mesh,
    Material=[{diffuse=RGB(221, 160, 221), emission=RGB(66, 48, 66), shine=0.5, specular=RGB(255, 255, 255), transparency=0}, {diffuse=RGB(120, 138, 155), emission=RGB(0, 0, 0), shine=0, specular=RGB(255, 255, 255), transparency=0.35}])
benchfrommesh = BenchFromMesh(Mesh=scanrecon.Mesh, BenchHeight=0)  # -> Box, Mesh, BenchBoundary, VertexCount
preview = CustomPreview(Geometry=scanrecon.Mesh, Material=ColourSwatch(SwatchColor=RGB(205, 170, 125)))
vertex_count = Panel(benchfrommesh.VertexCount)
bench_styled = CustomPreview(
    Geometry=benchfrommesh.Box,
    Material=[{diffuse=RGB(221, 160, 221), emission=RGB(66, 48, 66), shine=0.5, specular=RGB(255, 255, 255), transparency=0}, {diffuse=RGB(201, 168, 116), emission=RGB(0, 0, 0), shine=0, specular=RGB(255, 255, 255), transparency=0}])
