# Grasshopper definition 06_carving_stages.gh (Grasshopper 1.0.8)
# plug-ins: Frahan StonePack

# README: EX 05 CARVING STAGES
# Sculptor workflow: mesh -> staged carving guides.
# Wire a DECIMATED scan mesh; stages preview progressively.
swatch = ColourSwatch(SwatchColor=RGB(205, 170, 125))
M = M(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)
N = N(4)
mx = Mx(0.05)
fb = Fb(1)
carvestages = CarvingStages(Target=M, Stages=N, MaxOffset=mx, FinishAllowance=0, FeatureBoost=fb, Mode=0, FrontDirection=Vector(0, 1, 0), Run=True)  # -> Stages, Offsets, FeatureWeight, Count
preview = CustomPreview(Geometry=carvestages.Stages, Material=swatch)
S = Panel(carvestages.Stages)
O = Panel(carvestages.Offsets)
fw = Panel(carvestages.FeatureWeight)
N_2 = Panel(carvestages.Count)
