# Grasshopper definition stone_carving_simulation_LIGHT.gh (Grasshopper 1.0.8)
# plug-ins: Frahan StonePack

mesh = Mesh(<mesh referenced from the Rhino model>)
mesh_remesh_geogram = MeshRemeshGeogram(Mesh=mesh, Points=Slider(5000, range=0..10000), LloydIters=5, NewtonIters=30, Run=Toggle(True))  # -> Remeshed, Available, Report
close_holes = CloseHoles(
    Mesh=mesh_remesh_geogram.Remeshed,
    MaxHoleArea=1e+30,
    MaxHoleEdges=0,
    RepairAfter=True,
    Run=Toggle(True),
    Backend=Slider(2, range=0..10))  # -> Mesh, Closed, Report
volume = Volume(Geometry=close_holes.Mesh)  # -> Volume, Centroid
R = R(True)
sanitize_mesh = SanitizeMesh(Mesh=close_holes.Mesh, Backend=0, Run=R)  # -> Mesh, CGALReady, Report
enlarge_sculpture = EnlargeSculpture(Mesh=sanitize_mesh.Mesh, Mode=Slider(1, range=0..10), Value=Slider(1, range=0..10), TargetXYZ=Vector(0, 0, 0))  # -> Mesh, ScaleFactors, FinalSize, Volume
bounding_box = BoundingBox(Content=enlarge_sculpture.Mesh, Plane=PlaneXY(0, 0, 0))  # -> Box, Box_2
B = B(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)
mg = Mg(0.05)
fit_in_block = FitInBlock(Sculpture=enlarge_sculpture.Mesh, Block=B, Margin=mg, Place=True)  # -> Fits, Clearance, MaxScaleToFit, Placed, Report
number_slider = Slider(10, range=0..10)
number_slider_2 = Slider(0.1, range=0..0.1)
stone_aware_cut_export = StoneAwareCutExport(Geometry=fit_in_block.Placed, Write=False)  # -> FilePath, PieceCount, Report
carving_stages = CarvingStages(
    Target=fit_in_block.Placed,
    Stages=number_slider,
    MaxOffset=number_slider,
    FinishAllowance=Slider(0.01, range=0..0.01),
    FeatureBoost=Slider(0, range=0..100),
    Mode=Slider(1, range=0..1),
    FrontDirection="0,0,1",
    Run=True)  # -> Stages, Offsets, FeatureWeight, Count
fp = Panel(stone_aware_cut_export.FilePath)
N = Panel(stone_aware_cut_export.PieceCount)
R_2 = Panel(stone_aware_cut_export.Report)
list_item = ListItem(List=carving_stages.Stages, Index=Slider(0, range=0..10), Wrap=True)
