# Grasshopper definition 07_scan_ingest_full.gh (Grasshopper 1.0.8)
# plug-ins: Frahan StonePack

# README: EX 07 SCAN INGEST FULL
# Lag-free cloud pipeline: Load/LAS -> ICP -> Normals -> Reconstruct.
# 1. Set file paths to data/ scans (see README.md).
# 2. Voxel sliders control downsample density.
# 3. Flip each Run toggle IN ORDER (load, ICP, normals, reconstruct).
# Canvas never freezes: all heavy nodes run async.
# DATA_DRIVE: DATA - download from Google Drive FIRST
# https://drive.google.com/drive/folders/1mDj1Z20BB70SrkjQKnU6O3kDbfuA-mcS?usp=sharing
# 
# LiDAR/TLS:        granite_dells_tls/ot_GD_TLS_data_UTM.laz
# Photogrammetry:  tongjiang/detail_cloudAB.ply
# GPR:               gpr/grimsel/<AU file>.rd3
# Place the file under D:/code_ws/Data/<name>/ (the path this .gh reads),
# then set the file-path input. Datasets finish uploading within ~2h.
# Full list: data/DATA_ACCESS.md
voxel = Slider(0.05, range=0.01..1)
voxel_2 = Slider(0.05, range=0.01..1)
file = File("D:\code_ws\Template-General\raw\2026-05-27\tongjiang\detail_cloudAB.ply")
file_2 = File("D:\code_ws\Template-General\raw\2026-05-27\granite_dells_tls\ot_GD_TLS_data_UTM.laz")
M = M(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)
M_2 = M(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)
stoneprep = StonePrepScan(Meshes=M, Repair=True, Decimate=False, TargetTriangleCount=0)  # -> CleanedMeshes, Descriptors, MeshVolumes, Compactness, TriangleCounts, Trace, Skipped
readlas = ReadLASCloud(FilePath=file_2, VoxelSize=voxel_2, Run=Toggle(False))  # -> Points, InputCount, OutputCount, BoundingBox, Cloud
loadcloud = LoadCloud(FilePath=file, VoxelSize=voxel, Run=Toggle(False))  # -> Points, InputCount, OutputCount, BoundingBox, Cloud
scalecal = ScanScaleCalibrate(Meshes=M_2, Units="m")  # -> ScaleTransform, ScaleFactor, MeasuredLength, ScaledMeshes, Report
M_3 = M([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])
M_4 = M([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])
M_5 = M([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])
C = C(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)
cloudicp = CloudICP(MaxIterations=30, TrimFraction=0.2, Run=Toggle(False), SourceGeometry=loadcloud.Cloud, TargetGeometry=readlas.Cloud)  # -> Transform, FinalRMS, Iterations, Converged, Correspondences, Report
packstability = PackedPileStability(PlacedMeshes=M_4, Up=Vector(0, 0, 1), FloorZ=0, ZTolerance=0.001)  # -> Stable, FallingIds, AllStable
packoverlap = PerStoneOverlap(PlacedMeshes=M_3, Tolerance=1e-06)  # -> OverlapFractions, PenetratingIds, MaxOverlap
packcomcheck = CoMInContainerCheck(PlacedMeshes=M_5, Container=C, Tolerance=1e-06)  # -> Inside, CentresOfMass, MarginalIds
mc = Panel(stoneprep.CleanedMeshes)
D = Panel(stoneprep.Descriptors)
X = Panel(cloudicp.Transform)
rms = Panel(cloudicp.FinalRMS)
it = Panel(cloudicp.Iterations)
estnormals = EstimateCloudNormals(KNeighbours=18, Cloud=loadcloud.Cloud, Run=Toggle(False))  # -> Normals, Report, Cloud
scanrecon = ScanReconstruct(
    Mode=0,
    Alpha=0,
    PoissonDepth=8,
    SamplesPerNode=1.5,
    RadiusRatio=5,
    AFBeta=0.52,
    Cloud=estnormals.Cloud,
    Run=Toggle(False))  # -> Mesh, UsedMode, Report
preview = CustomPreview(
    Geometry=scanrecon.Mesh,
    Material={diffuse=RGB(221, 160, 221), emission=RGB(66, 48, 66), shine=0.5, specular=RGB(255, 255, 255), transparency=0})
