# Grasshopper definition marble_600_grid2.gh (Grasshopper 1.0.8)
# plug-ins: Frahan StonePack

file = File("D:\code_ws\Template-General\raw\2026-06-04\bondua_gpr\italy_extracted\g2_LA010011.DT")
preset = Preset("marble_600")
gprfracture = GPRFractureExtract(
    File=file,
    Preset=preset,
    Velocity=-1,
    Migrate=True,
    DepthEqualize=True,
    EnergyQuantile=-1,
    ContinuityTraces=-1,
    MinSupport=-1,
    MaxDip=-1,
    TraceMode=0)  # -> FracturePicks, Depths, Confidence, EnergyMesh, BedrockDepth, FractureId, FractureLines, Report
P = Panel(gprfracture.FracturePicks)
E = Panel(gprfracture.EnergyMesh)
Z = Panel(gprfracture.BedrockDepth)
L = Panel(gprfracture.FractureLines)
rpt = Panel(gprfracture.Report)
