# Grasshopper definition marble_600_grid3.gh (Grasshopper 1.0.8)
# plug-ins: Frahan StonePack

# README: GPR FRACTURE EXTRACTION
# Radargram -> migration -> fracture picks.
# 1. Construct GPR Preset feeds antenna/velocity settings.
# 2. Set the radargram file path (see README.md for data).
# 3. Solve; picks appear as curves/planes.
# Data: see folder README for the survey files.
gprpreset = ConstructGPRPreset(Stone="custom", Frequency=600, Velocity=0.1, Eps_r=9, EnergyQuantile=0.985, ContinuityTraces=27, Migrate=True)
file = File("D:\code_ws\Template-General\raw\2026-06-04\bondua_gpr\italy_extracted\g3_LA010003.DT")
gprfracture = GPRFractureExtract(
    File=file,
    Preset=gprpreset,
    Velocity=-1,
    Migrate=True,
    DepthEqualize=True,
    EnergyQuantile=-1,
    ContinuityTraces=-1,
    MinSupport=-1,
    MaxDip=-1,
    TraceMode=0,
    PermUncertainty=1,
    Tolerance=0.02)  # -> FracturePicks, Depths, Confidence, EnergyMesh, BedrockDepth, FractureId, FractureLines, Report, DepthSigma, ConfidenceWithinT
P = Panel(gprfracture.FracturePicks)
E = Panel(gprfracture.EnergyMesh)
Z = Panel(gprfracture.BedrockDepth)
L = Panel(gprfracture.FractureLines)
rpt = Panel(gprfracture.Report)
