# Grasshopper definition 10_pack2d_nfp_nest.gh (Grasshopper 1.0.8)
# plug-ins: Frahan StonePack

# ---- group: Frahan 2D Irregular Nesting | V506 (exact-NFP BLF, Burke 2006)
sheetw = Slider(2.72, range=0..5)
sheeth = Slider(1.7, range=0..5)
spacing = Slider(0.005, range=0..0.05)
# README: EX 10 PACK 2D (FLAGSHIP)
# Sheet Nest (Hole-Aware): exact NFP nesting, 0 overlap.
# UNITS: METRES (3.2 x 2.0 m slab). Parts internalized.
# Colours per part; utilization in the panel.
xy = XYPlane(Origin=Point(0, 0, 0))
toggle = BooleanToggle(True)

# ---- group: Frahan 2D Nesting | Sheet Nest (Hole-Aware)
rectangle = Rectangle(Plane=xy, XSize=sheetw, YSize=sheeth, Radius=0)  # -> Rectangle, Length
holenest = SheetNestHoleAware(
    Sheets=rectangle.Rectangle,
    Parts=[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],
    Spacing=spacing,
    BaseRotations=[4, 4],
    ContactRotations=[6, 4],
    Resolution=24,
    MultiStart=4)  # -> Placed, Source, Transform, Nested, Report, Density, Valid, PlacedHoles, Sheet
preview = CustomPreview(Geometry=[holenest.Placed, rectangle.Rectangle], Material=ColourSwatch(SwatchColor=RGB(186, 170, 144)))

# ----
boundary = BoundarySurfaces(Edges=holenest.Placed)
gradient = Gradient(
    LowerLimit=[0, 0],
    UpperLimit=[1, 17],
    Parameter=holenest.Source,
    stops=[0.0378: RGB(234, 38, 0), 0.244: RGB(234, 126, 0), 0.475: RGB(254, 244, 84), 0.75: RGB(173, 203, 249), 1: RGB(75, 107, 169)])
preview_2 = CustomPreview(Geometry=boundary, Material=gradient)
preview_3 = CustomPreview(
    Geometry=rectangle.Rectangle,
    Material=[{diffuse=RGB(221, 160, 221), emission=RGB(66, 48, 66), shine=0.5, specular=RGB(255, 255, 255), transparency=0}, {diffuse=RGB(60, 54, 48), emission=RGB(0, 0, 0), shine=0, specular=RGB(255, 255, 255), transparency=0}])
