# Grasshopper definition 10_pack2d_v506_nest.gh (Grasshopper 1.0.8)
# plug-ins: Frahan StonePack

# ---- group: Frahan 2D Irregular Nesting | V506 (exact-NFP BLF, Burke 2006)
sheetw = Slider(105.9, range=40..250)
sheeth = Slider(105.9, range=40..250)
spacing = Slider(0.5, range=0..5)
sortmode = Slider(1, range=0..4)
tol = Slider(0.01, range=0.001..0.1)
packseed = Slider(0, range=0..50)
xy = XYPlane(Origin=Point(0, 0, 0))
rectangle = Rectangle(Plane=xy, XSize=sheetw, YSize=sheeth, Radius=0)  # -> Rectangle, Length
freenestu = FrahanSheetPackUnified(
    Parts=[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],
    SheetOutlines=rectangle.Rectangle,
    Spacing=spacing,
    Rotations=[0, 90, 180, 270],
    SortMode=sortmode,
    Tolerance=tol,
    Seed=packseed,
    Run=Toggle(True),
    MaxCandidates=300,
    CornerMode=0,
    Variant=0,
    BoundaryMode=0,
    MinBoundaryAffinity=0.5,
    DiscretizationTolerance=-1,
    TrimTolerance=0)  # -> PackedCurves, Transforms, SourceIndices, SheetIndices, Unplaced, FailureReasons, SheetPreview, Report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
panel = Panel(freenestu.Report)
