# Grasshopper definition 11_pack3d_block_pack.gh (Grasshopper 1.0.8)
# plug-ins: Frahan StonePack

# ---- group: Frahan 3D Packing | Block Pack (Tree) - Kim 2025 guillotine, saw-cuttable
elemcount = Slider(12, range=4..40)
elemx0 = Slider(0.18, range=0..1)
elemxstep = Slider(0.018, range=-0.1..0.1)
elemy0 = Slider(0.3, range=0..1)
elemystep = Slider(-0.011, range=-0.1..0.1)
elemz = Slider(0.18, range=0..1)
contx = Slider(1.5, range=0..3)
conty = Slider(0.75, range=0..3)
contz = Slider(0.75, range=0..3)
rotmode = Slider(2, range=0..2)
forests = Slider(400, range=1..2000)
seed = Slider(0, range=0..100)
kerf = Slider(0.008, range=0..0.05)
contprice = Slider(100, range=1..1000)
zero = Slider(0, range=0..1)
xy = XYPlane(Origin=Point(0, 0, 0.75))
series = Series(Start=elemx0, Step=elemxstep, Count=elemcount)
series_2 = Series(Start=elemy0, Step=elemystep, Count=elemcount)
box = CenterBox(Base=xy, X=series, Y=series_2, Z=elemz)
box_2 = CenterBox(Base=xy, X=contx, Y=conty, Z=contz)
blockpacktree = BlockPackTree(
    Elements=box,
    ElementValues=series,
    Containers=box_2,
    ContainerPrices=contprice,
    RotationMode=rotmode,
    Forests=forests,
    Seed=seed,
    KerfWidth=kerf,
    CutSurfaceWeight=zero,
    MaxParallelism=zero,
    MemoryBudgetMB=zero)  # -> PlacedBoxes, Transforms, PlacedElementIds, PlacedContainerIds, UsedContainers, Score, AllPacked, BestForest, Report
panel = Panel(blockpacktree.Report)
