# Grasshopper definition 12_trencadis_catalog.gh (Grasshopper 1.0.8)
# plug-ins: Frahan StonePack

# ---- group: Frahan Trencadis Mosaic | Catalog Pack (CVD-Lloyd + Hungarian)
sheetw = Slider(1100, range=0..2000)
sheeth = Slider(1100, range=0..2000)
tol = Slider(0.05, range=0.001..1)
seed = Slider(3, range=0..50)
lloyd = Slider(12, range=0..40)
grout = Slider(5, range=0..50)
xy = XYPlane(Origin=Point(0, 0, 0))
rectangle = Rectangle(Plane=xy, XSize=sheetw, YSize=sheeth, Radius=0)  # -> Rectangle, Length
trencadiscat = FrahanTrencadísCatalogPack(
    Parts=[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],
    SheetOutlines=rectangle.Rectangle,
    Tolerance=tol,
    Seed=seed,
    Run=Toggle(True),
    LloydIterations=lloyd,
    Grout=grout)  # -> PlacedPieces, CellSeeds, SourceIndices, SheetIndices, CellAreas, Report
panel = Panel(trencadiscat.Report)

# ----
boundary = BoundarySurfaces(Edges=trencadiscat.PlacedPieces)
gradient = Gradient(
    LowerLimit=[0, 0],
    UpperLimit=[1, 99],
    Parameter=trencadiscat.SourceIndices,
    stops=[0.0378: RGB(234, 38, 0), 0.244: RGB(234, 126, 0), 0.475: RGB(254, 244, 84), 0.75: RGB(173, 203, 249), 1: RGB(75, 107, 169)])
preview = CustomPreview(Geometry=boundary, Material=gradient)
preview_2 = CustomPreview(Geometry=trencadiscat.PlacedPieces, Material=ColourSwatch(SwatchColor=RGB(60, 54, 48)))
