# Grasshopper definition 13_surface_segment.gh (Grasshopper 1.0.8)
# plug-ins: Frahan StonePack

# ---- group: Frahan Surfaces | Twisted block -> CGAL split by dihedral angle -> 6 surface regions
angle = Slider(35, range=15..90)
segmentanglecgal = MeshSegmentationByAngleCGAL(Mesh=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, Angle=angle, Run=Toggle(True))  # -> Segments, SegmentCount, Available, Report
series = Series(Start=[0, 0], Step=[1, 1], Count=[10, 6])
gradient = Gradient(
    LowerLimit=[0, 0],
    UpperLimit=[1, 5],
    Parameter=series,
    stops=[0.0378: RGB(234, 38, 0), 0.244: RGB(234, 126, 0), 0.475: RGB(254, 244, 84), 0.75: RGB(173, 203, 249), 1: RGB(75, 107, 169)])
panel = Panel(segmentanglecgal.Report)

# ----
preview = CustomPreview(Geometry=segmentanglecgal.Segments, Material=gradient)
