# Grasshopper definition 14_kintsugi_bb_parity.gh (Grasshopper 1.0.8)
# plug-ins: Frahan StonePack

# ---- group: Frahan Kintsugi | Breaking Bad parity (Port mode, Mesh Style 3, verifier 0.71)
bbload = LoadBBSample(SampleFile="D:\frahan-stonepack\examples\14_kintsugi\data\bb_sample_00697.bin", MeshStyle=3, Run=True)  # -> FragmentPoints, Fragments, FragmentCount, Report
kintsugi = FrahanKintsugi(
    Fragments=bbload.Fragments,
    JointWidth=1,
    SampleSpacing=1,
    BreakAngleDeg=8,
    MinSegmentLength=1,
    BeamWidth=32,
    MaxIterations=100,
    MinLoopLength=10,
    MaxRounds=6,
    VerifierPenetrationTol=0.5,
    DiffusionSteps=20,
    UsePortMode=True,
    Run=True,
    UseTorchSharp=False,
    PointClouds=bbload.FragmentPoints,
    VerifierAcceptThreshold=0.5,
    NonCrossing=False)  # -> AssembledFragments, Transforms, PlacedIndices, UnplacedIndices, Residuals, TotalResidual, RimPolylines, Report

# ----
preview = CustomPreview(Geometry=[bbload.Fragments, kintsugi.AssembledFragments], Material=ColourSwatch(SwatchColor=RGB(186, 170, 144)))
