# Grasshopper definition 14_kintsugi_escalation_rescue.gh (Grasshopper 1.0.8)
# plug-ins: Frahan StonePack

# KINTSUGI ESCALATION RESCUE (INC-1..4)
# Wire two real-scan fragment meshes (broken mug + its chip) into
# Facet Match > Fragments. High-res (400k) is fine.
# 
# Roughness Mode = True (real scans). Interlock Rescue toggle:
#   FALSE = pinned matcher only; a partial-rim sliver stays UNPLACED.
#   TRUE  = pass-2 interlock rescues it: segment on a ~100k decimated copy
#           (no 400k crash), interlock at full resolution seats the sliver
#           (residual < 0.55x). A different-object near-mate rejects (>= 0.55x).
# 
# Press Run. No ground truth ships: judge the seat VISUALLY.
# Wire your
# mug + chip
# meshes here
# (Fragments)
interlock_rescue = BooleanToggle(True)
run = BooleanToggle(False)
facetmatch = FacetMatch(
    AngleThreshold=30,
    MinFacetShare=0.05,
    JointWidth=1,
    PenetrationTol=0.5,
    SoftICP=False,
    Run=run,
    PenetrationHinge=False,
    AcceptFloor=1.3,
    RoughnessMode=True,
    RoughnessThreshold=0,
    InterlockRescue=interlock_rescue)  # -> Assembled, Transforms, PlacedIndices, UnplacedIndices, FacetOutlines, Report
preview = CustomPreview(
    Geometry=facetmatch.Assembled,
    Material={diffuse=RGB(221, 160, 221), emission=RGB(66, 48, 66), shine=0.5, specular=RGB(255, 255, 255), transparency=0})
panel = Panel(facetmatch.Report)
