# Grasshopper definition 14_kintsugi_facet_reassembly.gh (Grasshopper 1.0.8)
# plug-ins: Frahan StonePack

# ---- group: 1. GENERATE (impact Voronoi + pair-based rough interfaces)
synblock = SyntheticBlock(Shape=8, Size=100, Seed=42, Feature=0.5, Resolution=24, Variations=1)  # -> Blocks, ShapeName, Report
fragments = Slider(5, range=2..12)
seed = Slider(42, range=1..999)
run_shatter = BooleanToggle(False)
shatter = FragmentShatter(
    Solid=synblock.Blocks,
    FragmentCount=fragments,
    Seed=seed,
    Jitter=0.6,
    MinFragmentVolume=0.005,
    Run=run_shatter,
    ImpactBias=0.9)  # -> Fragments, SeedPoints, DropCount, Report
run_roughen = BooleanToggle(False)
roughen = FractureRoughen(
    Fragments=shatter.Fragments,
    Amplitude=0.05,
    Roughness=0.5,
    Seed=42,
    Run=run_roughen,
    Frequency=3,
    Octaves=4,
    CapCuts=True,
    CutResolution=0,
    RimTaper=0.04)  # -> RoughenedFragments, DisplacedCount, Report, FractureSurfaces

# ---- group: 2. SCRAMBLE (deterministic SE3, regions ride along)
scramble_seed = Slider(7, range=1..999)
scramble = ScrambleFragments(
    Fragments=roughen.RoughenedFragments,
    Seed=scramble_seed,
    MaxAngle=180,
    MaxOffset=0.3,
    Anchor=0,
    Regions=roughen.FractureSurfaces)  # -> Scrambled, Transforms, ScrambledRegions
explode_x = Slider(-220, range=-500..0)
X = UnitX(Factor=explode_x)
move = Move(Geometry=scramble.Scrambled, Motion=X)  # -> Geometry, Transform
preview = CustomPreview(Geometry=move.Geometry, Material=ColourSwatch(SwatchColor=RGB(170, 120, 110)))

# ---- group: 3. REASSEMBLE (async Facet Match, exact-correspondence regions)
run_facet_match_async = BooleanToggle(False)
facetmatch = FacetMatch(
    Fragments=scramble.Scrambled,
    AngleThreshold=30,
    MinFacetShare=0.05,
    JointWidth=1,
    PenetrationTol=0.5,
    SoftICP=True,
    Run=run_facet_match_async,
    PenetrationHinge=False,
    FractureRegions=scramble.ScrambledRegions,
    AcceptFloor=1.3)  # -> Assembled, Transforms, PlacedIndices, UnplacedIndices, FacetOutlines, Report
preview_2 = CustomPreview(Geometry=facetmatch.Assembled, Material=ColourSwatch(SwatchColor=RGB(218, 165, 32)))
report = Panel(facetmatch.Report)
