# Grasshopper definition 14_kintsugi_fantastic_breaks_bench.gh (Grasshopper 1.0.8)
# plug-ins: Frahan StonePack

# ---- group: 1. REFERENCE + NORMALIZE
# HOW TO: FANTASTIC BREAKS real-scan bench (no data shipped: the dataset has NO
# published license; download it yourself from the public Drive folder,
# see README). 1) Import an object's model_b_0.ply and model_r_0.ply into
# Rhino (_-Import). 2) In Rhino run _ReduceMesh to ~25k faces on the big
# piece (scan is 2.5M faces). 3) Right-click the two Mesh params -> Set
# One Mesh. 4) Toggle Run. STATUS 2026-07-12: precision holds (no false
# placements; debris negative control passes) but the chip does NOT yet
# place: dihedral segmentation cannot isolate the shallow fracture facet
# on the smooth household object. Open research: roughness-based
# fracture/skin classification (see research pack RQ1-RQ6).
broken_piece_model_b = Mesh()
repair_chip_model_r = Mesh()
scale_factor = Slider(100000, range=1..200000)
scale = Scale(Geometry=broken_piece_model_b, Center=Point(0, 0, 0), Factor=scale_factor)  # -> Geometry, Transform
scale_2 = Scale(Geometry=repair_chip_model_r, Center=Point(0, 0, 0), Factor=scale_factor)  # -> Geometry, Transform
merge = Merge(Data1=scale.Geometry, Data2=scale_2.Geometry)

# ---- group: 2. SCRAMBLE
scramble_seed = Slider(7, range=1..999)
scramble = ScrambleFragments(Fragments=merge, Seed=scramble_seed, MaxAngle=180, MaxOffset=0.3, Anchor=0)  # -> Scrambled, Transforms, ScrambledRegions
explode_x = Slider(-200, range=-400..0)
X = UnitX(Factor=explode_x)
move = Move(Geometry=scramble.Scrambled, Motion=X)  # -> Geometry, Transform
preview = CustomPreview(Geometry=move.Geometry, Material=ColourSwatch(SwatchColor=RGB(170, 120, 110)))

# ---- group: 3. REASSEMBLE (calibration knobs)
angle_threshold = Slider(14, range=6..40)
min_facet_share = Slider(0.005, range=0.001..0.2)
joint_width = Slider(3, range=0.1..10)
accept_floor = Slider(1.3, range=0.5..6)
run_facet_match_async = BooleanToggle(False)
facetmatch = FacetMatch(
    Fragments=scramble.Scrambled,
    AngleThreshold=angle_threshold,
    MinFacetShare=min_facet_share,
    JointWidth=joint_width,
    PenetrationTol=0.5,
    SoftICP=True,
    Run=run_facet_match_async,
    PenetrationHinge=False,
    AcceptFloor=accept_floor)  # -> Assembled, Transforms, PlacedIndices, UnplacedIndices, FacetOutlines, Report
preview_2 = CustomPreview(Geometry=facetmatch.Assembled, Material=ColourSwatch(SwatchColor=RGB(218, 165, 32)))
report = Panel(facetmatch.Report)
