# Grasshopper definition 14_kintsugi_rims_facets_bench.gh (Grasshopper 1.0.8)
# plug-ins: Frahan StonePack

# RIMS + FACETS reassembly test bench (2026-07-11).
# Shared generator: Synthetic Block > Fragment Shatter (impact-biased).
# GROUP A (gold): Roughen v2 (per-interface decorrelated relief, capped)
#   > Scramble > FACET MATCH. Blue = facet outlines diagnostic.
# GROUP B (green): OPEN shatter fragments > Scramble > FRAHAN KINTSUGI
#   geometric path (Interface Split rim arcs + skin-normal gate).
# Run order: Run Shatter > Run Roughen > the match toggles.
# Both matchers print candidate diagnostics in their Report output.
# STATUS: precision gates verified (no wrong placements); recall on
# this synthetic set is the open work item - see the Reports. Real
# scanned fragments (flatter facets) are the friendlier target.
synblock = SyntheticBlock(Shape=8, Size=100, Seed=42, Feature=0.5, Resolution=24, Variations=1)  # -> Blocks, ShapeName, Report
run_shatter = BooleanToggle(False)
shatter = FragmentShatter(Solid=synblock.Blocks, FragmentCount=8, Seed=42, Jitter=0.6, MinFragmentVolume=0.005, Run=run_shatter, ImpactBias=0.9)  # -> Fragments, SeedPoints, DropCount, Report
amplitude = Slider(0.05, range=0..0.1)
run_roughen = BooleanToggle(False)
roughen = FractureRoughen(
    Fragments=shatter.Fragments,
    Amplitude=amplitude,
    Roughness=0.5,
    Seed=42,
    Run=run_roughen,
    Frequency=3,
    Octaves=4,
    CapCuts=True,
    CutResolution=0,
    RimTaper=0.04)  # -> RoughenedFragments, DisplacedCount, Report, FractureSurfaces
scramble_seed = Slider(7, range=0..100)
scramble = ScrambleFragments(
    Fragments=roughen.RoughenedFragments,
    Seed=scramble_seed,
    MaxAngle=180,
    MaxOffset=0.3,
    Anchor=0,
    Regions=roughen.FractureSurfaces)  # -> Scrambled, Transforms, ScrambledRegions
scramble_2 = ScrambleFragments(Fragments=shatter.Fragments, Seed=scramble_seed, MaxAngle=180, MaxOffset=0.3, Anchor=0)  # -> Scrambled, Transforms, ScrambledRegions
run_facet_match = BooleanToggle(False)
run_rim_match = BooleanToggle(False)
kintsugi = Kintsugi(
    Fragments=scramble_2.Scrambled,
    JointWidth=1,
    SampleSpacing=1,
    BreakAngleDeg=8,
    MinSegmentLength=1,
    BeamWidth=32,
    MaxIterations=2000,
    MinLoopLength=10,
    MaxRounds=6,
    VerifierPenetrationTol=0.5,
    DiffusionSteps=20,
    UsePortMode=False,
    Run=run_rim_match,
    UseTorchSharp=False,
    VerifierAcceptThreshold=0.5,
    NonCrossing=False,
    InterfaceSplit=0)  # -> AssembledFragments, Transforms, PlacedIndices, UnplacedIndices, Residuals, TotalResidual, RimPolylines, Report
facetmatch = FacetMatch(
    Fragments=scramble.Scrambled,
    AngleThreshold=30,
    MinFacetShare=0.05,
    JointWidth=1,
    PenetrationTol=0.5,
    SoftICP=True,
    Run=run_facet_match,
    PenetrationHinge=False,
    AcceptFloor=scramble.ScrambledRegions,
    AcceptFloor_2=1.3)  # -> Assembled, Transforms, PlacedIndices, UnplacedIndices, FacetOutlines, Report
preview = CustomPreview(Geometry=facetmatch.Assembled, Material=ColourSwatch(SwatchColor=RGB(212, 175, 55)))
preview_2 = CustomPreview(Geometry=facetmatch.FacetOutlines, Material=ColourSwatch(SwatchColor=RGB(52, 152, 219)))
preview_3 = CustomPreview(Geometry=kintsugi.AssembledFragments, Material=ColourSwatch(SwatchColor=RGB(46, 204, 113)))
