# Grasshopper definition 14_kintsugi_synthetic.gh (Grasshopper 1.0.8)
# plug-ins: Frahan StonePack

# SYNTHETIC fracture data for the Kintsugi learned path (2026-07-11).
# Chain: Synthetic Block > Fragment Shatter > Fracture Roughen > Kintsugi.
# Generators are aligned to the Breaking Bad training distribution
# (impact-biased volumes, watertight pieces, rough mating surfaces).
# 1. Toggle Run Shatter, then Run Roughen (fast).
# 2. Toggle Run Kintsugi for the learned Port path (async, minutes;
#    needs kintsugi.bin beside the .gha). Read the Report scores first.
# Measured: verifier max 0.603 / 3 STRONG pairs on this synthetic chain;
# real Breaking Bad baseline 0.533 / 1; OLD generator 0.062 / 0.
# Impact Bias 0 restores the legacy equal-cell shatter. Amplitude 0.006 =
# real-granite facet roughness (measured); 0.05 = Breaking Bad band.
synblock = SyntheticBlock(Shape=8, Size=100, Seed=42, Feature=0.5, Resolution=24, Variations=1)  # -> Blocks, ShapeName, Report
fragment_count = Slider(8, range=2..20)
seed = Slider(42, range=0..100)
impact_bias = Slider(0.9, range=0..1)
run_shatter = BooleanToggle(True)
shatter = FragmentShatter(
    Solid=synblock.Blocks,
    FragmentCount=fragment_count,
    Seed=seed,
    Jitter=0.6,
    MinFragmentVolume=0.005,
    Run=run_shatter,
    ImpactBias=impact_bias)  # -> Fragments, SeedPoints, DropCount, Report
amplitude = Slider(0.05, range=0..0.1)
run_roughen = BooleanToggle(False)
roughen = FractureRoughen(
    Fragments=shatter.Fragments,
    Amplitude=amplitude,
    Roughness=0.5,
    Seed=42,
    Run=run_roughen,
    Frequency=3,
    Octaves=4,
    CapCuts=True,
    CutResolution=0,
    RimTaper=0.04)  # -> RoughenedFragments, DisplacedCount, Report
preview = CustomPreview(Geometry=roughen.RoughenedFragments, Material=ColourSwatch(SwatchColor=RGB(230, 126, 34)))
run_kintsugi_async_minutes = BooleanToggle(True)
use_port_mode = BooleanToggle(True)
kintsugi = Kintsugi(
    Fragments=shatter.Fragments,
    JointWidth=1,
    SampleSpacing=1,
    BreakAngleDeg=8,
    MinSegmentLength=1,
    BeamWidth=32,
    MaxIterations=2000,
    MinLoopLength=10,
    MaxRounds=6,
    VerifierPenetrationTol=0.5,
    DiffusionSteps=20,
    UsePortMode=use_port_mode,
    Run=run_kintsugi_async_minutes,
    UseTorchSharp=use_port_mode,
    VerifierAcceptThreshold=0.5,
    NonCrossing=False)  # -> AssembledFragments, Transforms, PlacedIndices, UnplacedIndices, Residuals, TotalResidual, RimPolylines, Report
panel = Panel(kintsugi.Report)
panel_2 = Panel(kintsugi.RimPolylines)
preview_2 = CustomPreview(Geometry=kintsugi.AssembledFragments, Material=ColourSwatch(SwatchColor=RGB(212, 175, 55)))
