# Grasshopper definition 15C_coacd_demo.gh (Grasshopper 1.0.8)
# plug-ins: Frahan StonePack

bunny = Mesh(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)
threshold_m = Slider(0.06, range=0..0.3)
realmetric = BooleanToggle(True)
run = BooleanToggle(False)
quarrydccoacd = QuarryDecomposeByCoACD(Quarry=bunny, Threshold=threshold_m, RealMetric=realmetric, MaxPieces=-1, Seed=0, Run=run)  # -> Blocks, Count, Available, Report
preview = CustomPreview(Geometry=quarrydccoacd.Blocks, Material=ColourSwatch(SwatchColor=RGB(186, 170, 144)))
