# Grasshopper definition 16_rubble_wall.gh (Grasshopper 1.0.8)
# plug-ins: Frahan StonePack

eth_stones = Mesh([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])
rubblesettle = RubbleWallSettle(Stones=eth_stones, Width=8, StabilityAware=True, Margin=0)  # -> Settled, Stable, Clearance
preview = CustomPreview(Geometry=rubblesettle.Settled, Material=ColourSwatch(SwatchColor=RGB(186, 170, 144)))
masonstable = MasonryStabilityCheck(Stones=rubblesettle.Settled, Mu=0.84, Faces=8, FixBelowZ=0.01, Density=2400, ContactTol=0.005, AngleTol=5, CRA=True)  # -> Stable, Report, Utilization
stabilityverdict = Panel(masonstable.Report)
