# Grasshopper definition 17_ashlar_wall.gh (Grasshopper 1.0.8)
# plug-ins: Frahan StonePack

blocks = Mesh([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])
ashlarpack = AshlarPack(
    WallWidth=3,
    WallHeight=1.2,
    WallThickness=0.3,
    Meshes=blocks,
    CourseMode=0,
    TargetCourseHeight=0.15,
    BedJoint=0.005,
    HeadJoint=0.005,
    StaggerOffset=0.5,
    Density=2400,
    HeightTolerance=0.05,
    StartPlane=Plane(origin=(-1.234321012e+308, -1.234321012e+308, -1.234321012e+308), x=(0, 0, 0), y=(0, 0, 0)))  # -> Assembly, Result, DisplayTransform
packprev = PackPreview(Result=ashlarpack.Result)
preview = CustomPreview(Geometry=packprev, Material=ColourSwatch(SwatchColor=RGB(186, 170, 144)))
masonstable = MasonryStabilityCheck(Stones=packprev, Mu=0.84, Faces=8, FixBelowZ=0.01, Density=2400, ContactTol=0.005, AngleTol=5, CRA=True)  # -> Stable, Report, Utilization
stabilityverdict = Panel(masonstable.Report)
