# Grasshopper definition 18_pack_settle_bullet.gh (Grasshopper 1.0.8)
# plug-ins: Frahan StonePack

container = Mesh(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)
stones = Mesh([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])
settle3d = Settle3DPhysics(Meshes=stones, Container=container, Friction=0.6, SettleSteps=400, Tamp=5, CoACD=False, Run=True)  # -> SettledMeshes, Transforms, SourceIndices, Report
preview = CustomPreview(Geometry=settle3d.SettledMeshes, Material=ColourSwatch(SwatchColor=RGB(186, 170, 144)))
