# Grasshopper definition 19_rubble_evolved_fit.gh (Grasshopper 1.0.8)
# plug-ins: Frahan StonePack, Frahan RubblePack

blocks = Mesh([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])
stones = Mesh([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])
run = BooleanToggle(True)
rubblefit = RubbleEvolvedFit(Blocks=blocks, Stones=stones, Candidates=12, Seed=12345, Run=run)  # -> Placed, StoneIndex, Yield, Report
preview = CustomPreview(Geometry=rubblefit.Placed, Material=ColourSwatch(SwatchColor=RGB(186, 170, 144)))
masonstable = MasonryStabilityCheck(Stones=rubblefit.Placed, Mu=0.84, Faces=8, FixBelowZ=0.01, Density=2400, ContactTol=0.005, AngleTol=5, CRA=True)  # -> Stable, Report, Utilization
stabilityverdict = Panel(masonstable.Report)
