# Grasshopper definition 20_rubble_multibin.gh (Grasshopper 1.0.8)
# plug-ins: Frahan StonePack, Frahan RubblePack

blocks = Mesh([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])
stones = Mesh([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])
run = BooleanToggle(True)
rubblebinpack = RubbleMultiBinPack(Blocks=blocks, Stones=stones, VoxelSize=0.04, Kerf=0.005, Run=run)  # -> Placed, BinIndex, BinFill, Report
preview = CustomPreview(Geometry=rubblebinpack.Placed, Material=ColourSwatch(SwatchColor=RGB(186, 170, 144)))
masonstable = MasonryStabilityCheck(Stones=rubblebinpack.Placed, Mu=0.84, Faces=8, FixBelowZ=0.01, Density=2400, ContactTol=0.005, AngleTol=5, CRA=True)  # -> Stable, Report, Utilization
stabilityverdict = Panel(masonstable.Report)
