# Grasshopper definition 26_loviisa_vector_load.gh (Grasshopper 1.0.8)
# plug-ins: Frahan StonePack

F = F("D:\code_ws\Template-General\raw\2026-05-22\zenodo_loviisa\U-Net_Traces\KB11_2022.shp")
vecfrac = VectorFracturesLoader(FilePath=F)  # -> Traces, Count, CRSWKT, AttributeKeys, AttributeValues, SourceFile
len = Length(Curve=vecfrac.Traces)
T = Panel(vecfrac.Traces)
N = Panel(vecfrac.Count)
crs = Panel(vecfrac.CRSWKT)
ak = Panel(vecfrac.AttributeKeys)
av = Panel(vecfrac.AttributeValues)
src = Panel(vecfrac.SourceFile)
gradient = Gradient(
    LowerLimit=[0, 0],
    UpperLimit=[1, 4.089556058],
    Parameter=len,
    stops=[0.0378: RGB(234, 38, 0), 0.244: RGB(234, 126, 0), 0.475: RGB(254, 244, 84), 0.75: RGB(173, 203, 249), 1: RGB(75, 107, 169)])
preview = CustomPreview(Geometry=vecfrac.Traces, Material=ColourSwatch(SwatchColor=RGB(186, 170, 144)))
preview_2 = CustomPreview(Geometry=vecfrac.Traces, Material=gradient)
