# Grasshopper definition 27_06_wall_generator_stability.gh (Grasshopper 1.0.8)
# plug-ins: Frahan StonePack

width = Slider(3, range=1..6)
height = Slider(1.8, range=0.5..3)
coursing = Slider(0.4, range=0..1)
gridx = Slider(5, range=3..14)
gridy = Slider(3, range=2..8)
lloyd = Slider(2, range=0..6)
sizegrade = Slider(0.3, range=0..0.6)
mortar = Slider(0.05, range=0..0.2)
seed = Slider(7, range=1..99)
polywall = PolygonalWallGenerator(
    Surface=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,
    Width=width,
    Height=height,
    Coursing=coursing,
    Courses=5,
    GridX=gridx,
    GridY=gridy,
    Depth=0.2,
    Mortar=mortar,
    Seed=seed,
    Lloyd=lloyd,
    SizeGrade=sizegrade)  # -> Stones, Count, Interlock, Report, Assembly
masonstable = MasonryStabilityCheck(
    Stones=polywall.Stones,
    Mu=0.84,
    Faces=8,
    FixBelowZ=0.01,
    Density=2400,
    ContactTol=0.005,
    AngleTol=5,
    Assembly=polywall.Assembly,
    CRA=True)  # -> Stable, Report, Utilization
preview = CustomPreview(Geometry=polywall.Stones, Material=ColourSwatch(SwatchColor=RGB(172, 152, 124)))
stability = Panel(masonstable.Report)
pattern = Panel(polywall.Report)
