# Grasshopper definition 27_07_stone_match_lambda.gh (Grasshopper 1.0.8)
# plug-ins: Frahan StonePack

coursing = Slider(0.4, range=0..1)
cellsgx = Slider(5, range=3..12)
cellsgy = Slider(3, range=2..8)
mortar0 = Slider(0, range=0..0.2)
invseed = Slider(23, range=1..99)
invgx = Slider(6, range=3..12)
invgy = Slider(4, range=2..8)
invsizegrade = Slider(0.45, range=0..0.6)
polywall = PolygonalWallGenerator(
    Width=3,
    Height=1.8,
    Coursing=coursing,
    Courses=5,
    GridX=cellsgx,
    GridY=cellsgy,
    Depth=0.2,
    Mortar=mortar0,
    Seed=7,
    Lloyd=2,
    SizeGrade=0.3)  # -> Stones, Count, Interlock, Report, Assembly
polywall_2 = PolygonalWallGenerator(
    Width=3,
    Height=1.8,
    Coursing=0.4,
    Courses=5,
    GridX=invgx,
    GridY=invgy,
    Depth=0.2,
    Mortar=mortar0,
    Seed=invseed,
    Lloyd=2,
    SizeGrade=invsizegrade)  # -> Stones, Count, Interlock, Report, Assembly
masonstable = MasonryStabilityCheck(
    Stones=polywall.Stones,
    Mu=0.84,
    Faces=8,
    FixBelowZ=0.01,
    Density=2400,
    ContactTol=0.005,
    AngleTol=5,
    Assembly=polywall.Assembly,
    CRA=True)  # -> Stable, Report, Utilization
stonematchl = StoneCellMatchΛ(Stones=polywall_2.Stones, Cells=polywall.Stones, TopK=6, CostRes=12, RefineRes=24)  # -> Placed, Carve, Gap, Lambda, StoneIndex, Unused, Report
X = UnitX(Factor=4.2)
X_2 = UnitX(Factor=-4.2)
move = Move(Geometry=stonematchl.Placed, Translation=X)
move_2 = Move(Geometry=polywall_2.Stones, Translation=X_2)
gradient = Gradient(
    LowerLimit=0,
    UpperLimit=0.5,
    Parameter=stonematchl.Carve,
    stops=[0: RGB(0, 128, 0), 0.5: RGB(255, 255, 0), 1: RGB(255, 0, 0)])
preview = CustomPreview(Geometry=polywall.Stones, Material=ColourSwatch(SwatchColor=RGB(208, 208, 202)))
preview_2 = CustomPreview(Geometry=move, Material=gradient)
preview_3 = CustomPreview(Geometry=move_2, Material=ColourSwatch(SwatchColor=RGB(198, 185, 162)))
