# Grasshopper definition 27_07_voronoi_3d.gh (Grasshopper 1.0.8)
# plug-ins: Frahan StonePack

cells = Cells([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])
polymasonryseq3d = PolygonalMasonrySequence3D(Cells=cells, FaceTolerance=0.001, ZThreshold=0.001)  # -> Stones, InstallOrder, Depth, DAGEdges, CellCount
preview = CustomPreview(Geometry=polymasonryseq3d.Stones, Material=ColourSwatch(SwatchColor=RGB(196, 183, 160)))
_07_voronoi_3d_install_order = Panel(polymasonryseq3d.InstallOrder)
