# Grasshopper definition 27_08_negative_cases.gh (Grasshopper 1.0.8)
# plug-ins: Frahan StonePack

# NEGATIVE CASES - the RED is EXPECTED.
# 8a: non-monotone chain -> component correctly ERRORS (0 stones).
# 8b: crossing chains -> degenerate output. The validator rejecting bad
# chains IS the demonstrated behaviour.
chains = Chains(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)
wall = Wall({Plane=PlaneXY(0, 0, 0), Size=Domain2(u=0..10, v=0..8)})
chains_2 = Chains([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])
wall_2 = Wall({Plane=PlaneXY(0, 0, 0), Size=Domain2(u=12..22, v=0..8)})
preview = CustomPreview(
    Geometry=chains,
    Material=[{diffuse=RGB(221, 160, 221), emission=RGB(66, 48, 66), shine=0.5, specular=RGB(255, 255, 255), transparency=0}, {diffuse=RGB(190, 40, 35), emission=RGB(0, 0, 0), shine=0, specular=RGB(255, 255, 255), transparency=0}])
preview_2 = CustomPreview(
    Geometry=wall,
    Material=[{diffuse=RGB(221, 160, 221), emission=RGB(66, 48, 66), shine=0.5, specular=RGB(255, 255, 255), transparency=0}, {diffuse=RGB(70, 64, 58), emission=RGB(0, 0, 0), shine=0, specular=RGB(255, 255, 255), transparency=0}])
preview_3 = CustomPreview(
    Geometry=chains_2,
    Material=[{diffuse=RGB(221, 160, 221), emission=RGB(66, 48, 66), shine=0.5, specular=RGB(255, 255, 255), transparency=0}, {diffuse=RGB(190, 40, 35), emission=RGB(0, 0, 0), shine=0, specular=RGB(255, 255, 255), transparency=0}])
preview_4 = CustomPreview(
    Geometry=wall_2,
    Material=[{diffuse=RGB(221, 160, 221), emission=RGB(66, 48, 66), shine=0.5, specular=RGB(255, 255, 255), transparency=0}, {diffuse=RGB(70, 64, 58), emission=RGB(0, 0, 0), shine=0, specular=RGB(255, 255, 255), transparency=0}])
polymasonryseq = PolygonalMasonrySequence(Chains=chains, Wall=wall, Epsilon=1e-07)  # -> Stones, InstallOrder, Depth, DAGEdges, RegionCount
polymasonryseq_2 = PolygonalMasonrySequence(Chains=chains_2, Wall=wall_2, Epsilon=1e-07)  # -> Stones, InstallOrder, Depth, DAGEdges, RegionCount
