# Grasshopper definition 27_09_ifc_export.gh (Grasshopper 1.0.8)
# plug-ins: Frahan StonePack

coursing = Slider(0.4, range=0..1)
gridx = Slider(5, range=3..12)
gridy = Slider(3, range=2..8)
mortar = Slider(0.05, range=0..0.2)
polywall = PolygonalWallGenerator(
    Width=3,
    Height=1.8,
    Coursing=coursing,
    Courses=5,
    GridX=gridx,
    GridY=gridy,
    Depth=0.2,
    Mortar=mortar,
    Seed=7,
    Lloyd=2,
    SizeGrade=0.3)  # -> Stones, Count, Interlock, Report, Assembly
masonstable = MasonryStabilityCheck(
    Stones=polywall.Stones,
    Mu=0.84,
    Faces=8,
    FixBelowZ=0.01,
    Density=2400,
    ContactTol=0.005,
    AngleTol=5,
    Assembly=polywall.Assembly,
    CRA=True)  # -> Stable, Report, Utilization
ifcstones = IFCExportStoneAssembly(
    Stones=polywall.Stones,
    Name="PolygonalStoneWall",
    Path="D:\code_ws\outputs\2026-06-10\masonry_evolution\hitl\27_09_polygonal_wall.ifc",
    Container=0,
    Stability=0,
    InterlockJ=polywall.Interlock,
    Run=True)  # -> Path, Report, OK
preview = CustomPreview(Geometry=polywall.Stones, Material=ColourSwatch(SwatchColor=RGB(172, 152, 124)))
stability = Panel(masonstable.Report)
ifc = Panel(ifcstones.Report)
