# Grasshopper definition 27_10_castle_keep.gh (Grasshopper 1.0.8)
# plug-ins: Frahan StonePack

coursing = Slider(0.4, range=0..1)
mortar = Slider(0.05, range=0..0.2)
tymppanels = PolygonalWallGenerator(
    Width=5.2,
    Height=1.4,
    Coursing=coursing,
    Courses=5,
    GridX=5,
    GridY=2,
    Depth=0.4,
    Mortar=mortar,
    Seed=[51, 53, 57, 59],
    Lloyd=2,
    SizeGrade=0.3)  # -> Stones, Count, Interlock, Report, Assembly
arch = ArchVoussoirs(
    Profile=0,
    IntradosRadius=0.8,
    RingThickness=0.35,
    Width=0.4,
    Count=9,
    IncludedAngle=180,
    Rise=0,
    BasePoint=Point(0, 0, 0))  # -> Cells, Assembly, BedPlanes, Centroids, Volumes, Keystone, Intrados, Report
vault = PendentiveVaultVoussoirs(SphereRadius=4.2, SquareHalfWidth=2.6, ShellThickness=0.3, GridU=6, GridV=3, DropToGround=True, BasePoint=Point(0, 0, 0))  # -> Cells, Assembly, BedPlanes, Centroids, Volumes, Report
domesphere = Sphere(Base=PlaneXY(3, 3, 1.37), Radius=4.2)
polywalls = PolygonalWallGenerator(
    Width=[2.2, 2.2, 6, 5.2, 5.2],
    Height=3.2,
    Coursing=coursing,
    Courses=5,
    GridX=[2, 2, 5, 5, 5],
    GridY=3,
    Depth=0.4,
    Mortar=mortar,
    Seed=[7, 13, 7, 7, 7],
    Lloyd=2,
    SizeGrade=0.3)  # -> Stones, Count, Interlock, Report, Assembly
tymprot = Rotate(Geometry=tymppanels.Stones, Angle=graft([0, 0, 1.570796327, 1.570796327]), Plane=PlaneXY(0, 0, 0))
series = Series(Start=0, Step=0.5, Count=6)
domemesh = MeshBrep(
    Brep=domesphere,
    Settings={GridMaxCount=0, GridMinCount=16, JaggedSeams=False, MaxEdgeLength=0, MinEdgeLength=0.0001, MinTolerance=0, Refine=True, RefineAngle=0, RelativeTolerance=0.65, SimplePlanes=True, Tolerance=0})
placerot = Rotate(Geometry=polywalls.Stones, Angle=graft([0, 0, 0, 1.570796327, 1.570796327]), Plane=PlaneXY(0, 0, 0))
tympplace = Move(
    Geometry=tymprot,
    Translation=graft([Vector(0.4, 0, 3.2), Vector(0.4, 5.6, 3.2), Vector(0.4, 0.4, 3.2), Vector(6, 0.4, 3.2)]))
tympanum = MeshCSGCGAL(MeshA=flatten(tympplace), MeshB=domemesh, Operation=1, UseHybridKernel=False, Run=True)  # -> Result, Backend, Available, Version, Report
placewalls = Move(
    Geometry=placerot,
    Translation=graft([Vector(0, 0, 0), Vector(3.8, 0, 0), Vector(0, 5.6, 0), Vector(0.4, 0.4, 0), Vector(6, 0.4, 0)]))
mvarch = Move(Geometry=arch.Cells, Translation=Vector(3, 0.2, 2))
mvvault = Move(Geometry=vault.Cells, Translation=Vector(3, 3, 3.2))
wallbranches = ExplodeTree(Data=placewalls)  # -> Branch0, Branch1, Branch2, Branch3, Branch4
containers = Entwine(
    Branch00=wallbranches.Branch0,
    Branch01=wallbranches.Branch1,
    Branch02=wallbranches.Branch2,
    Branch03=wallbranches.Branch3,
    Branch04=wallbranches.Branch4,
    Branch05=mvarch,
    Branch06=mvvault,
    Branch07=flatten(tympanum.Result),
    FlattenInputs=True)
stabwall = MasonryStabilityCheck(Mu=0.84, Faces=8, FixBelowZ=0.01, Density=2400, ContactTol=0.005, AngleTol=5, Assembly=polywalls.Assembly, CRA=True)  # -> Stable, Report, Utilization
stabarch = MasonryStabilityCheck(Stones=arch.Cells, Mu=0.84, Faces=8, FixBelowZ=0.05, Density=2400, ContactTol=0.005, AngleTol=5, CRA=False)  # -> Stable, Report, Utilization
stabvault = MasonryStabilityCheck(Stones=vault.Cells, Mu=0.84, Faces=8, FixBelowZ=0.05, Density=2400, ContactTol=0.005, AngleTol=5, CRA=False)  # -> Stable, Report, Utilization
ifccastle = IFCExportBuilding(
    Stones=containers,
    Names=["Keep_JambLeft", "Keep_JambRight", "Keep_WallBack", "Keep_WallLeft", "Keep_WallRight", "Portal_Arch", "Pendentive_Dome", "Tympanum_Infill"],
    Containers=[0, 0, 0, 0, 0, 2, 3, 0],
    Path="D:\code_ws\outputs\2026-06-10\masonry_evolution\hitl\27_10_castle_keep.ifc",
    Project="Frahan Castle Keep",
    Run=True)  # -> Path, Report, OK
preview = CustomPreview(Geometry=containers, Material=ColourSwatch(SwatchColor=RGB(176, 158, 130)))
vaultverdict = Panel(stabvault.Report)
wallverdict = Panel(stabwall.Report)
archverdict = Panel(stabarch.Report)
ifc = Panel(ifccastle.Report)
