# Grasshopper definition 28_hole_nest_demo.gh (Grasshopper 1.0.8)
# plug-ins: Frahan StonePack

holenest = SheetNestHoleAware(
    Sheet=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,
    SheetHoles=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,
    Parts=[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],
    PartHoles=Tree({0}: [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], {1}: [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], {2}: [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], {3}: [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]),
    Spacing=0,
    BaseRotations=4,
    ContactRotations=6)  # -> Placed, Source, Transform, Nested, Report, Density, Valid
preview = CustomPreview(Geometry=holenest.Placed, Material=ColourSwatch(SwatchColor=RGB(186, 170, 144)))
nestreport = Panel(holenest.Report)
