# Grasshopper definition 30_discontinuity_sets.gh (Grasshopper 1.0.8)
# plug-ins: Frahan StonePack

# Frahan StonePack - Example 30
# Discontinuity Sets -> Stereonet + Block size
# Site: Tongjiang granite quarry
# Scan: tongjiang_detail_decim.ply (393k pts, decimated)
# Units: m   Date: 2026-06-14
# Press RUN (stage 1) to segment.
toggle = BooleanToggle(False)
panel = Panel("D:\frahan-stonepack\examples\30_discontinuity_sets\tongjiang_detail_decim.ply")
discsetsa = DiscontinuitySetsAsync(
    File=panel,
    K=24,
    MaxAngle=12,
    MinFacetPts=40,
    Bandwidth=Slider(12, range=5..20),
    MinSetFacets=4,
    MaxPoints=Slider(400000, range=100000..2000000),
    Run=toggle,
    KeepFacets=Toggle(True))  # -> Segmented, SetPoles, Dip, DipDir, Spacing, FacetsSet, Report, Share, FacetsPath
stereonet = StereonetBlockSize(
    Dip=discsetsa.Dip,
    DipDir=discsetsa.DipDir,
    Spacing=discsetsa.Spacing,
    Share=discsetsa.Share,
    FacetsPath=discsetsa.FacetsPath,
    Plane=PlaneXY(70, 30, 0),
    Radius=Slider(30, range=5..60),
    UnitScale=Slider(100, range=1..1000),
    EqualArea=Toggle(True))  # -> Net, GreatCircles, SetPoles, FacetPoles, Jv, Vb, RQD, Deq, Report
panel_2 = Panel(discsetsa.Report)
panel_3 = Panel(stereonet.Report)
