# Grasshopper definition 31_discontinuity_ingest.gh (Grasshopper 1.0.8)
# plug-ins: Frahan StonePack

# Frahan StonePack - Example 31
# Discontinuity Ingest -> planes coloured by joint set
# Input: survey_discontinuities.csv (26 measured planes)
# Reads dip/dipdir/set; builds oriented planes; colours by set.
# Units: m   Date: 2026-06-14
panel = Panel("D:\frahan-stonepack\examples\31_discontinuity_ingest\survey_discontinuities.csv")
discin = DiscontinuityIngest(File=panel, Origin=Point(0, 0, 0))  # -> Planes, Traces, Dip, DipDir, SetId, Report
panel_2 = Panel(discin.Report)
dom = ConstructDomain(DomainStart=Slider(-2, range=-5..5), DomainEnd=Slider(2, range=-5..5))
rectangle = Rectangle(Plane=discin.Planes, XSize=dom, YSize=dom, Radius=0)  # -> Rec, Length
boundary = BoundarySurfaces(Edges=rectangle.Rec)
gradient = Gradient(
    LowerLimit=Slider(1, range=0..10),
    UpperLimit=Slider(5, range=0..10),
    Parameter=discin.SetId,
    stops=[0.0378: RGB(234, 38, 0), 0.244: RGB(234, 126, 0), 0.475: RGB(254, 244, 84), 0.75: RGB(173, 203, 249), 1: RGB(75, 107, 169)])
preview = CustomPreview(Geometry=boundary, Material=gradient)
