# Grasshopper definition 32_scan_to_blocks.gh (Grasshopper 1.0.8)
# plug-ins: Frahan StonePack

# Frahan StonePack - Example 32
# Scan -> joint sets -> DFN -> EVOLVED block packing (Omni: subdivision + coarse-to-fine + Pareto)
# Site: Tongjiang granite quarry. Units: m. Spacing scale 100 (cm detail-scan -> bench m).
# No mesh reconstruction: the DFN is a clean fracture mesh by construction.
# Press RUN (1) to segment, then the graph flows to the cut yield.
panel = Panel("D:\code_ws\Data\tongjiang\detail_cloudXB.ply")
discsetsa = DiscontinuitySetsAsync(
    File=panel,
    K=24,
    MaxAngle=12,
    MinFacetPts=40,
    Bandwidth=Slider(12, range=5..20),
    MinSetFacets=4,
    MaxPoints=Slider(1000000, range=100000..2000000),
    Run=Toggle(False),
    KeepFacets=Toggle(True))  # -> Segmented, SetPoles, Dip, DipDir, Spacing, FacetsSet, Report, Share, FacetsPath
sets2dfn = JointSetsToDFN(
    Dip=discsetsa.Dip,
    DipDir=discsetsa.DipDir,
    Spacing=discsetsa.Spacing,
    SpacingScale=Slider(100, range=1..500),
    Bench={Plane=PlaneXY(0, 0, 0), X=Domain(0, 3), Y=Domain(0, 2), Z=Domain(0, 2)},
    Seed=Slider(1, range=1..20),
    ExpSpacing=False)  # -> DFN, TestedArea, Fractures, SetsUsed, Report
stereonet = StereonetBlockSize(
    Dip=discsetsa.Dip,
    DipDir=discsetsa.DipDir,
    Spacing=discsetsa.Spacing,
    Share=discsetsa.Share,
    FacetsPath=discsetsa.FacetsPath,
    Plane=PlaneXY(70, 30, 0),
    Radius=Slider(30, range=5..60),
    UnitScale=Slider(100, range=1..500),
    EqualArea=Toggle(True))  # -> Net, GreatCircles, SetPoles, FacetPoles, Jv, Vb, RQD, Deq, Report
bcoomni = BlockCutOptOmniSolve(
    TestedArea=sets2dfn.TestedArea,
    Fractures=sets2dfn.DFN,
    Mx=Slider(3, range=1..5),
    My=Slider(2, range=1..5),
    BlockX=Slider(0.25, range=0.1..1),
    BlockY=Slider(0.25, range=0.1..1),
    BlockZ=Slider(0.2, range=0.1..1),
    Kerf=0.05,
    PsiStepDeg=3,
    Run=Toggle(False))  # -> ZoneId, BestRecoveryCount, BestRevenue, BestBCSdbBV, BestPsiDeg, AggregateRecovery
panel_2 = Panel(bcoomni.AggregateRecovery)
