# Grasshopper definition marble_oblique_hero.gh (Grasshopper 1.0.8)
# plug-ins: Frahan StonePack

panel = Panel("""D:\code_ws\outputs\2026-06-15\quarry_workflows\data\gpr\LA010001.DT
D:\code_ws\outputs\2026-06-15\quarry_workflows\data\gpr\LA010002.DT""")
linespacing = Slider(2.6, range=0.5..8)
gprgrid = GPRSurveyGrid(Files=panel, Preset="marble_600", LineSpacing=linespacing, Velocity=-1, EnergyQuantile=-1, MaxDip=-1, Migrate=True)  # -> FracturePicks, LineId, Confidence, Depths, EnergySections, BedrockDepth, Report
numfractures = Slider(3, range=1..6)
gridres = Slider(26, range=10..40)
gprfrac3d = GPRFractureSurfaces3D(
    FracturePicks=gprgrid.FracturePicks,
    NumFractures=numfractures,
    GridRes=gridres,
    Velocity=0.1,
    Frequency=600,
    Eps_r=9,
    PermUncertainty=1,
    Tolerance=0.02,
    AssumeOpen=True,
    TimeZero=0,
    DetectBase=0.8,
    ThroughPicks=True,
    PickEnergy=gprgrid.Confidence,
    PeakDedup=True)  # -> FractureSurfaces, Confidence, MeanSigma, OverallConfidence, Report, Detectability, EffectiveConfidence
bbox = BoundingBox(Content=flatten([gprgrid.FracturePicks, gprfrac3d.FractureSurfaces]), Plane=PlaneXY(0, 0, 0), UnionBox=True)  # -> Box, Box_2
volumeweight_w = Slider(0, range=0..3000)
keepout = Slider(0.05, range=0..0.3)
oblique = BooleanToggle(True)
mcol = MeshColours(Mesh=gprfrac3d.FractureSurfaces, Colours=ColourSwatch(SwatchColor=RGBA(70, 180, 90, 150)))
bedblocks = BedBlockLayout(
    Bench=bbox.Box,
    BedSurfaces=gprfrac3d.FractureSurfaces,
    VolumeWeight=volumeweight_w,
    Oblique=oblique,
    CutCost=200,
    KeepOut=keepout)  # -> Blocks, Class, Volume, NetValue, Count, Report
preview = CustomPreview(
    Geometry=mcol,
    Material={diffuse=RGB(221, 160, 221), emission=RGB(66, 48, 66), shine=0.5, specular=RGB(255, 255, 255), transparency=0})
volume = Volume(Geometry=bedblocks.Blocks)  # -> Volume, Centroid
gradient = Gradient(
    LowerLimit=1.217534461,
    UpperLimit=6.62141902,
    Parameter=volume.Volume,
    stops=[0: RGB(242, 163, 60), 0.5: RGB(46, 204, 138), 1: RGB(46, 155, 214)])
preview_2 = CustomPreview(Geometry=bedblocks.Blocks, Material=gradient)
