# Grasshopper definition quarry_full_workflow.gh (Grasshopper 1.0.8)
# plug-ins: Frahan StonePack

gpr_dt_files = GPRDTFiles(["D:\frahan-stonepack\examples\35_gpr_quarry_full_workflow\gpr_data\g1_LA010001.DT", "D:\frahan-stonepack\examples\35_gpr_quarry_full_workflow\gpr_data\g1_LA010002.DT", "D:\frahan-stonepack\examples\35_gpr_quarry_full_workflow\gpr_data\g1_LA010003.DT", "D:\frahan-stonepack\examples\35_gpr_quarry_full_workflow\gpr_data\g1_LA010004.DT", "D:\frahan-stonepack\examples\35_gpr_quarry_full_workflow\gpr_data\g1_TA010009.DT", "D:\frahan-stonepack\examples\35_gpr_quarry_full_workflow\gpr_data\g1_TA010010.DT", "D:\frahan-stonepack\examples\35_gpr_quarry_full_workflow\gpr_data\g1_TA010011.DT", "D:\frahan-stonepack\examples\35_gpr_quarry_full_workflow\gpr_data\g1_TA010012.DT"])
gprpreset = ConstructGPRPreset(Stone="limestone", Frequency=600, Velocity=0.1, Eps_r=9, EnergyQuantile=0.985, ContinuityTraces=27, Migrate=True)
numfractures = Slider(3, range=1..6)
gridres = Slider(26, range=12..40)
through_picks = BooleanToggle(True)
peak_dedup = BooleanToggle(True)
packer_5_staged_guillotine = Slider(5, range=0..6)
gprgrid = GPRSurveyGrid(
    Files=gpr_dt_files,
    Preset="granite_160",
    LineSpacing=2,
    Velocity=-1,
    EnergyQuantile=-1,
    MaxDip=-1,
    Migrate=True,
    CustomPreset=gprpreset)  # -> FracturePicks, LineId, Confidence, Depths, EnergySections, BedrockDepth, Report
gprfrac3d = GPRFractureSurfaces3D(
    FracturePicks=gprgrid.FracturePicks,
    NumFractures=numfractures,
    GridRes=gridres,
    Velocity=0.1,
    Frequency=600,
    Eps_r=9,
    PermUncertainty=1,
    Tolerance=0.02,
    AssumeOpen=True,
    TimeZero=0,
    DetectBase=0.8,
    ThroughPicks=through_picks,
    PickEnergy=gprgrid.Confidence,
    PeakDedup=peak_dedup)  # -> FractureSurfaces, Confidence, MeanSigma, OverallConfidence, Report, Detectability, EffectiveConfidence
bedslabs = FractureBoundedSlabs(
    Bench={Plane=PlaneXY(0, 0, 0), X=Domain(0, 7), Y=Domain(0, 4), Z=Domain(-4.4, 0.3)},
    BedSurfaces=gprfrac3d.FractureSurfaces,
    GridRes=gridres,
    KeepOut=0)  # -> Slabs, Thickness, Report
fracblockpack = FractureBlockPack(
    ContainerMeshes=bedslabs.Slabs,
    BlockLength=0.9,
    BlockWidth=0.7,
    BlockHeight=0.4,
    Kerf=0.03,
    FractureClearance=0,
    Run=True,
    UncertaintySafe=False,
    Packer=packer_5_staged_guillotine)  # -> Blocks, BinIndex, BlockCount, RecoveredVolume, Yield, Report
preview = CustomPreview(Geometry=fracblockpack.Blocks, Material=ColourSwatch(SwatchColor=RGB(255, 255, 255)))
