# Grasshopper definition quarry_full_workflow_fab_tail.gh (Grasshopper 1.0.8)
# plug-ins: Frahan StonePack

gpr_dt_files_botticino_g1 = GPRDTFilesBotticinoG1(["D:\frahan-stonepack\examples\35_gpr_quarry_full_workflow\gpr_data\g1_LA010001.DT", "D:\frahan-stonepack\examples\35_gpr_quarry_full_workflow\gpr_data\g1_LA010002.DT", "D:\frahan-stonepack\examples\35_gpr_quarry_full_workflow\gpr_data\g1_LA010003.DT", "D:\frahan-stonepack\examples\35_gpr_quarry_full_workflow\gpr_data\g1_LA010004.DT", "D:\frahan-stonepack\examples\35_gpr_quarry_full_workflow\gpr_data\g1_TA010009.DT", "D:\frahan-stonepack\examples\35_gpr_quarry_full_workflow\gpr_data\g1_TA010010.DT", "D:\frahan-stonepack\examples\35_gpr_quarry_full_workflow\gpr_data\g1_TA010011.DT", "D:\frahan-stonepack\examples\35_gpr_quarry_full_workflow\gpr_data\g1_TA010012.DT"])
gprpreset = ConstructGPRPreset(Stone="limestone", Frequency=600, Velocity=0.1, Eps_r=9, EnergyQuantile=0.985, ContinuityTraces=27, Migrate=True)
gprgrid = GPRSurveyGrid(
    Files=gpr_dt_files_botticino_g1,
    Preset="granite_160",
    LineSpacing=2,
    Velocity=-1,
    EnergyQuantile=-1,
    MaxDip=-1,
    Migrate=True,
    CustomPreset=gprpreset)  # -> FracturePicks, LineId, Confidence, Depths, EnergySections, BedrockDepth, Report
numfractures = Slider(3, range=1..6)
gridres = Slider(26, range=10..60)
through_picks = BooleanToggle(True)
peak_dedup = BooleanToggle(True)
gprfrac3d = GPRFractureSurfaces3D(
    FracturePicks=gprgrid.FracturePicks,
    NumFractures=numfractures,
    GridRes=gridres,
    Velocity=0.1,
    Frequency=600,
    Eps_r=9,
    PermUncertainty=1,
    Tolerance=0.02,
    AssumeOpen=True,
    TimeZero=0,
    DetectBase=0.8,
    ThroughPicks=through_picks,
    PickEnergy=gprgrid.Confidence,
    PeakDedup=peak_dedup)  # -> FractureSurfaces, Confidence, MeanSigma, OverallConfidence, Report, Detectability, EffectiveConfidence
preview = CustomPreview(
    Geometry=gprfrac3d.FractureSurfaces,
    Material={diffuse=RGB(214, 170, 80), emission=RGB(64, 51, 24), shine=0.5, specular=RGB(255, 255, 255), transparency=0.5294117647})
demesh = DeconstructMesh(Mesh=gprfrac3d.FractureSurfaces)  # -> Vertices, Faces, Colours, Normals
plfit = PlaneFit(Points=demesh.Vertices)  # -> Plane, Deviation
deplane = DeconstructPlane(Plane=plfit.Plane)  # -> Origin, XAxis, YAxis, ZAxis
devec = DeconstructVector(Vector=deplane.ZAxis)  # -> XComponent, YComponent, ZComponent
bed_dip_dir = Expression(
    x=devec.XComponent,
    y=devec.YComponent,
    z=devec.ZComponent,
    Expression="((Deg(Atan2(x, y)) + If(z<0, 180, 0) + 360) % 360)")
bed_dip = Expression(z=devec.ZComponent, Expression="Deg(ACos(Abs(z)))")
saw_sheet_bin = Slider(2, range=0..3)
cutopt = CutOrientation(Dip=flatten(bed_dip), DipDir=flatten(bed_dip_dir), Bench=True, Center=Point(3.45, 1.9, -2.2), Extent=7.5)  # -> CutPlanes, CutDip, CutDipDir, FollowsSet, Obliquity, MaxObliquity, Fit, CutRectangles, Report
nominal_block_l_x_w_x_h_m = NominalBlockLXWXHM(Vector(0.9, 0.7, 0.4))
bedslabs = FractureBoundedSlabs(
    Bench={Plane=PlaneXY(0, 0, 0), X=Domain(0, 7), Y=Domain(0, 4), Z=Domain(-4.4, 0)},
    BedSurfaces=gprfrac3d.FractureSurfaces,
    GridRes=gridres,
    KeepOut=0)  # -> Slabs, Thickness, Report
packer_5_staged_guillotine = Slider(5, range=1..5)
run_pack = BooleanToggle(True)
fracblockpack = FractureBlockPack(
    ContainerMeshes=flatten(bedslabs.Slabs),
    BlockLength=0.9,
    BlockWidth=0.7,
    BlockHeight=0.4,
    Kerf=0.03,
    FractureClearance=0,
    Run=run_pack,
    UncertaintySafe=False,
    Packer=packer_5_staged_guillotine)  # -> Blocks, BinIndex, BlockCount, RecoveredVolume, Yield, Report, SawPasses
item = ListItem(List=flatten(fracblockpack.BlockCount), Index=saw_sheet_bin, Wrap=True)
branch = TreeBranch(Tree=fracblockpack.SawPasses, Path=saw_sheet_bin, MaintainPaths=True)
dup = DuplicateData(Data=flatten(nominal_block_l_x_w_x_h_m), Number=flatten(item), Order=True)
write_dxf = BooleanToggle(False)
write_compas = BooleanToggle(False)
stagesplit = CutStageSplit(CutLines=flatten(branch), GangsawBlock=Vector(3, 1.9, 1.5), ProductSize=nominal_block_l_x_w_x_h_m, Kerf=0.03)  # -> QuarryCuts, FactoryCuts, QuarryLabels, FactoryLabels, PrimaryBlocks, Report
compas = COMPASExport(
    Blocks=flatten(fracblockpack.Blocks),
    Units="m",
    Loader=True,
    FilePath="D:\frahan-stonepack\examples\35_gpr_quarry_full_workflow\quarry_fab_blocks_compas.json",
    Write=write_compas)  # -> FilePath, Loader, Blocks, Frames, Report
preview_2 = CustomPreview(
    Geometry=flatten(fracblockpack.Blocks),
    Material={diffuse=RGB(70, 160, 90), emission=RGB(21, 48, 27), shine=0.5, specular=RGB(255, 255, 255), transparency=0})
preview_3 = CustomPreview(
    Geometry=flatten(bedslabs.Slabs),
    Material={diffuse=RGB(150, 150, 150), emission=RGB(45, 45, 45), shine=0.5, specular=RGB(255, 255, 255), transparency=0.6470588235})
move = Move(Geometry=flatten(fracblockpack.Blocks), Motion=Vector(8, 0, 0))  # -> Geometry, Transform
merge = Merge(Data1=stagesplit.QuarryCuts, Data2=stagesplit.FactoryCuts)
merge_2 = Merge(Data1=stagesplit.QuarryLabels, Data2=stagesplit.FactoryLabels)
facemap = BlockFaceMap(
    Block={Plane=PlaneXY(0, 0, 0), X=Domain(0, 7), Y=Domain(0, 4), Z=Domain(-4.4, 0)},
    Fractures=flatten(gprfrac3d.FractureSurfaces),
    CutLines=flatten(merge),
    Gap=0.3,
    Bottom=False,
    CutLabels=flatten(merge_2))  # -> FaceOutlines, FaceIds, FractureTraces, CutTraces, Report, TraceLabels
move_2 = Move(Geometry=flatten(facemap.CutTraces), Motion=Vector(0, 14, 0))  # -> Geometry, Transform
move_3 = Move(Geometry=flatten(facemap.FaceOutlines), Motion=Vector(0, 14, 0))  # -> Geometry, Transform
move_4 = Move(Geometry=flatten(facemap.FractureTraces), Motion=Vector(0, 14, 0))  # -> Geometry, Transform
dxfcut = DXFCutPlan(
    Curves=flatten(facemap.FaceOutlines),
    PieceIds=facemap.FaceIds,
    FlattenNest=False,
    Gap=0.045,
    SheetWidth=0,
    TextHeight=0,
    FilePath="D:\frahan-stonepack\examples\35_gpr_quarry_full_workflow\quarry_fab_cutplan.dxf",
    Write=write_dxf,
    Schedule=True,
    CutLines=flatten(facemap.CutTraces),
    Sizes=flatten(dup),
    Title="Botticino g1 GPR bench - block cut plan (Bondua; Tinti et al. 2024)",
    Units="m",
    FractureTraces=flatten(facemap.FractureTraces),
    CutLabels=flatten(facemap.TraceLabels))  # -> FilePath, Count, Layout, Report
preview_4 = CustomPreview(
    Geometry=move_3.Geometry,
    Material={diffuse=RGB(30, 30, 30), emission=RGB(9, 9, 9), shine=0.5, specular=RGB(255, 255, 255), transparency=0})
preview_5 = CustomPreview(
    Geometry=move_4.Geometry,
    Material={diffuse=RGB(255, 140, 0), emission=RGB(76, 42, 0), shine=0.5, specular=RGB(255, 255, 255), transparency=0})
preview_6 = CustomPreview(
    Geometry=move_2.Geometry,
    Material={diffuse=RGB(200, 30, 60), emission=RGB(60, 9, 18), shine=0.5, specular=RGB(255, 255, 255), transparency=0})
end = EndPoints(Curve=move_2.Geometry)  # -> Start, End
preview_7 = CustomPreview(
    Geometry=move.Geometry,
    Material={diffuse=RGB(60, 120, 200), emission=RGB(18, 36, 60), shine=0.5, specular=RGB(255, 255, 255), transparency=0})
tag = TextTag3D(Location=end.Start, Text=flatten(facemap.TraceLabels), Size=0.25, Colour=RGB(200, 30, 60), Justification=7)
