# Grasshopper definition fractured_block_to_slabs.gh (Grasshopper 1.0.8)
# plug-ins: Frahan StonePack

fracture_bedding_plane = FractureBeddingPlane(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)
slab_grid_res = Slider(28, range=12..40)
bedslabs = FractureBoundedSlabs(
    Bench={Plane=PlaneXY(0, 0, 0), X=Domain(0, 2), Y=Domain(0, 1), Z=Domain(-1.2, 0)},
    BedSurfaces=fracture_bedding_plane,
    GridRes=slab_grid_res,
    KeepOut=0)  # -> Slabs, Thickness, Report
preview = CustomPreview(Geometry=bedslabs.Slabs, Material=ColourSwatch(SwatchColor=RGB(210, 185, 140)))
preview_2 = CustomPreview(Geometry=fracture_bedding_plane, Material=ColourSwatch(SwatchColor=RGB(200, 90, 90)))
