# Grasshopper definition 36_structural_stone_facade.gh (Grasshopper 1.0.8)
# plug-ins: Frahan StonePack

width = Slider(7.2, range=1..20)
height = Slider(5.4, range=1..20)
depth = Slider(0.6, range=0.2..2)
course = Slider(0.6, range=0.2..2)
blocklength = Slider(1.2, range=0.3..3)
minlength = Slider(0.6, range=0.1..2)
lintelbearing = Slider(0.6, range=0..1.5)
w1_x0 = Slider(1.2, range=0..9)
w1_x1 = Slider(3, range=0..9)
w1_z0 = Slider(1.2, range=0..6)
w1_z1 = Slider(3, range=0..6)
w2_x0 = Slider(4.2, range=0..9)
w2_x1 = Slider(6, range=0..9)
w2_z0 = Slider(1.2, range=0..6)
w2_z1 = Slider(3, range=0..6)
xz = XZPlane(Origin=Point(0, 0, 0))
pt = ConstructPoint(XCoordinate=w1_x0, YCoordinate=0, ZCoordinate=w1_z0)
pt_2 = ConstructPoint(XCoordinate=w1_x1, YCoordinate=0, ZCoordinate=w1_z1)
pt_3 = ConstructPoint(XCoordinate=w2_x0, YCoordinate=0, ZCoordinate=w2_z0)
pt_4 = ConstructPoint(XCoordinate=w2_x1, YCoordinate=0, ZCoordinate=w2_z1)
rec_2pt = Rectangle2Pt(Plane=xz, PointA=pt, PointB=pt_2, Radius=0)  # -> Rectangle, Length
rec_2pt_2 = Rectangle2Pt(Plane=xz, PointA=pt_3, PointB=pt_4, Radius=0)  # -> Rectangle, Length
structwall = StructuralWallGenerator(
    Width=width,
    Height=height,
    Depth=depth,
    Course=course,
    BlockLength=blocklength,
    MinLength=minlength,
    LintelBearing=lintelbearing,
    Openings=[rec_2pt.Rectangle, rec_2pt_2.Rectangle])  # -> Stones, Count, Lintels, Report, Assembly
mu = Slider(0.6, range=0.1..1.2)
masonstable = MasonryStabilityCheck(
    Mu=mu,
    Faces=8,
    FixBelowZ=0.01,
    Density=2400,
    ContactTol=0.005,
    AngleTol=5,
    Assembly=structwall.Assembly,
    CRA=Toggle(True))  # -> Stable, Report, Utilization
buildord = BlockBuildOrder(Assembly=structwall.Assembly, UpVector=Vector(0, 0, 1), UpToleranceDeg=30)  # -> OrderedBlockIds, OrderedMeshes, OrderIndex, Layer
