# Grasshopper definition panel_tile_surface.gh (Grasshopper 1.0.8)
# plug-ins: Frahan StonePack

facade = Facade(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)
slabs_sheets = SlabsSheets([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])
u_count = Slider(12, range=4..20)
v_count = Slider(7, range=3..14)
paneltile = PanelTileSurface(Surface=facade, UCount=u_count, VCount=v_count, Joint=0.005, Planarize=True)  # -> Panels, CutTiles, Planarity, Area, Report
holenest = SheetNestHoleAware(
    Sheets=slabs_sheets,
    Parts=paneltile.CutTiles,
    Spacing=0,
    BaseRotations=4,
    ContactRotations=6,
    Resolution=24,
    MultiStart=4)  # -> Placed, Source, Transform, Nested, Report, Density, Valid, PlacedHoles, Sheet
preview = CustomPreview(Geometry=paneltile.Panels, Material=ColourSwatch(SwatchColor=RGB(180, 200, 215)))
