# Grasshopper definition concave_nest.gh (Grasshopper 1.0.8)
# plug-ins: Frahan StonePack

sheet_concave_offcut = Sheet(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)
concave_parts = Parts([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])
spacing = Spacing(0.02)
holenest = SheetNestHoleAware(
    Sheets=sheet_concave_offcut,
    Parts=concave_parts,
    Spacing=spacing,
    BaseRotations=4,
    ContactRotations=6,
    Resolution=24,
    MultiStart=4)  # -> Placed, Source, Transform, Nested, Report, Density, Valid, PlacedHoles, Sheet
boundary = BoundarySurfaces(Edges=holenest.Placed)
gradient = Gradient(
    LowerLimit=[0, 0],
    UpperLimit=[1, 5],
    Parameter=holenest.Source,
    stops=[0.0378: RGB(234, 38, 0), 0.244: RGB(234, 126, 0), 0.475: RGB(254, 244, 84), 0.75: RGB(173, 203, 249), 1: RGB(75, 107, 169)])
preview = CustomPreview(Geometry=holenest.Placed, Material=ColourSwatch(SwatchColor=RGB(150, 190, 150)))
preview_2 = CustomPreview(Geometry=boundary, Material=gradient)
preview_3 = CustomPreview(
    Geometry=sheet_concave_offcut,
    Material=[{diffuse=RGB(221, 160, 221), emission=RGB(66, 48, 66), shine=0.5, specular=RGB(255, 255, 255), transparency=0}, {diffuse=RGB(60, 54, 48), emission=RGB(0, 0, 0), shine=0, specular=RGB(255, 255, 255), transparency=0}])
