# Grasshopper definition andesite_pipeline.gh (Grasshopper 1.0.8)
# plug-ins: Frahan StonePack

gprgrid = GPRSurveyGrid(
    Files=["d:/code_ws/Data/gpr/pietroasa_andesite/Longitudinal/Profile227.gsf", "d:/code_ws/Data/gpr/pietroasa_andesite/Longitudinal/Profile228.gsf", "d:/code_ws/Data/gpr/pietroasa_andesite/Longitudinal/Profile229.gsf", "d:/code_ws/Data/gpr/pietroasa_andesite/Longitudinal/Profile230.gsf", "d:/code_ws/Data/gpr/pietroasa_andesite/Longitudinal/Profile231.gsf", "d:/code_ws/Data/gpr/pietroasa_andesite/Longitudinal/Profile232.gsf", "d:/code_ws/Data/gpr/pietroasa_andesite/Longitudinal/Profile233.gsf", "d:/code_ws/Data/gpr/pietroasa_andesite/Longitudinal/Profile234.gsf", "d:/code_ws/Data/gpr/pietroasa_andesite/Longitudinal/Profile235.gsf", "d:/code_ws/Data/gpr/pietroasa_andesite/Longitudinal/Profile236.gsf", "d:/code_ws/Data/gpr/pietroasa_andesite/Transversal/Profile237.gsf", "d:/code_ws/Data/gpr/pietroasa_andesite/Transversal/Profile238.gsf", "d:/code_ws/Data/gpr/pietroasa_andesite/Transversal/Profile239.gsf", "d:/code_ws/Data/gpr/pietroasa_andesite/Transversal/Profile240.gsf", "d:/code_ws/Data/gpr/pietroasa_andesite/Transversal/Profile241.gsf", "d:/code_ws/Data/gpr/pietroasa_andesite/Transversal/Profile242.gsf", "d:/code_ws/Data/gpr/pietroasa_andesite/Transversal/Profile243.gsf", "d:/code_ws/Data/gpr/pietroasa_andesite/Transversal/Profile244.gsf", "d:/code_ws/Data/gpr/pietroasa_andesite/Transversal/Profile245.gsf", "d:/code_ws/Data/gpr/pietroasa_andesite/Transversal/Profile246.gsf", "d:/code_ws/Data/gpr/pietroasa_andesite/Transversal/Profile247.gsf", "d:/code_ws/Data/gpr/pietroasa_andesite/Transversal/Profile248.gsf", "d:/code_ws/Data/gpr/pietroasa_andesite/Transversal/Profile249.gsf", "d:/code_ws/Data/gpr/pietroasa_andesite/Transversal/Profile250.gsf", "d:/code_ws/Data/gpr/pietroasa_andesite/Transversal/Profile251.gsf", "d:/code_ws/Data/gpr/pietroasa_andesite/Transversal/Profile252.gsf", "d:/code_ws/Data/gpr/pietroasa_andesite/Transversal/Profile253.gsf", "d:/code_ws/Data/gpr/pietroasa_andesite/Transversal/Profile254.gsf", "d:/code_ws/Data/gpr/pietroasa_andesite/Transversal/Profile255.gsf", "d:/code_ws/Data/gpr/pietroasa_andesite/Transversal/Profile256.gsf", "d:/code_ws/Data/gpr/pietroasa_andesite/Transversal/Profile257.gsf", "d:/code_ws/Data/gpr/pietroasa_andesite/Transversal/Profile258.gsf", "d:/code_ws/Data/gpr/pietroasa_andesite/Transversal/Profile259.gsf", "d:/code_ws/Data/gpr/pietroasa_andesite/Transversal/Profile260.gsf", "d:/code_ws/Data/gpr/pietroasa_andesite/Transversal/Profile261.gsf", "d:/code_ws/Data/gpr/pietroasa_andesite/Transversal/Profile262.gsf", "d:/code_ws/Data/gpr/pietroasa_andesite/Transversal/Profile263.gsf", "d:/code_ws/Data/gpr/pietroasa_andesite/Transversal/Profile264.gsf", "d:/code_ws/Data/gpr/pietroasa_andesite/Transversal/Profile265.gsf", "d:/code_ws/Data/gpr/pietroasa_andesite/Transversal/Profile266.gsf", "d:/code_ws/Data/gpr/pietroasa_andesite/Transversal/Profile267.gsf"],
    Preset="andesite_390",
    LineSpacing=0.5,
    Velocity=0.0831,
    EnergyQuantile=-1,
    MaxDip=-1,
    Migrate=True,
    Orientation=[0, 0, 0, 0, 0, 0, 0, 0, 0, 0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])  # -> FracturePicks, LineId, Confidence, Depths, EnergySections, BedrockDepth, Report
panel = Panel(gprgrid.Report)
preview = CustomPreview(Geometry=gprgrid.FracturePicks, Material=ColourSwatch(SwatchColor=RGB(200, 60, 60)))
preview_2 = CustomPreview(Geometry=gprgrid.EnergySections, Material=ColourSwatch(SwatchColor=RGB(232, 150, 70)))
gprfrac3d = GPRFractureSurfaces3D(
    FracturePicks=gprgrid.FracturePicks,
    NumFractures=-1,
    GridRes=36,
    Velocity=0.0831,
    Frequency=600,
    Eps_r=13.03,
    PermUncertainty=1,
    Tolerance=0.02,
    AssumeOpen=True,
    TimeZero=0,
    DetectBase=0.8,
    ThroughPicks=True,
    PickEnergy=gprgrid.Confidence,
    PeakDedup=True)  # -> FractureSurfaces, Confidence, MeanSigma, OverallConfidence, Report, Detectability, EffectiveConfidence
panel_2 = Panel(gprfrac3d.Report)
preview_3 = CustomPreview(Geometry=gprfrac3d.FractureSurfaces, Material=ColourSwatch(SwatchColor=RGB(110, 135, 150)))
bedslabs = FractureBoundedSlabs(
    Bench={Plane=PlaneXY(0, 0, 0), X=Domain(0, 6.1), Y=Domain(0, 6.9), Z=Domain(-3.3, 0.3)},
    BedSurfaces=gprfrac3d.FractureSurfaces,
    GridRes=26,
    KeepOut=0)  # -> Slabs, Thickness, Report
panel_3 = Panel(bedslabs.Report)
preview_4 = CustomPreview(Geometry=bedslabs.Slabs, Material=ColourSwatch(SwatchColor=RGB(120, 150, 130)))
fracblockpack = FractureBlockPack(
    ContainerMeshes=bedslabs.Slabs,
    BlockLength=0.9,
    BlockWidth=0.7,
    BlockHeight=0.4,
    Kerf=0.03,
    FractureClearance=0,
    Run=True,
    UncertaintySafe=False,
    Packer=5)  # -> Blocks, BinIndex, BlockCount, RecoveredVolume, Yield, Report
panel_4 = Panel(fracblockpack.Report)
preview_5 = CustomPreview(Geometry=fracblockpack.Blocks, Material=ColourSwatch(SwatchColor=RGB(150, 120, 140)))
