# Grasshopper definition travertine_pipeline.gh (Grasshopper 1.0.8)
# plug-ins: Frahan StonePack

gprgrid = GPRSurveyGrid(
    Files=["d:/code_ws/Data/gpr/carpinis_travertine/Longitudinal/Profile311.gsf", "d:/code_ws/Data/gpr/carpinis_travertine/Longitudinal/Profile312.gsf", "d:/code_ws/Data/gpr/carpinis_travertine/Longitudinal/Profile313.gsf", "d:/code_ws/Data/gpr/carpinis_travertine/Longitudinal/Profile314.gsf", "d:/code_ws/Data/gpr/carpinis_travertine/Longitudinal/Profile315.gsf", "d:/code_ws/Data/gpr/carpinis_travertine/Longitudinal/Profile316.gsf", "d:/code_ws/Data/gpr/carpinis_travertine/Longitudinal/Profile317.gsf", "d:/code_ws/Data/gpr/carpinis_travertine/Longitudinal/Profile318.gsf", "d:/code_ws/Data/gpr/carpinis_travertine/Longitudinal/Profile319.gsf", "d:/code_ws/Data/gpr/carpinis_travertine/Longitudinal/Profile320.gsf", "d:/code_ws/Data/gpr/carpinis_travertine/Longitudinal/Profile321.gsf", "d:/code_ws/Data/gpr/carpinis_travertine/Longitudinal/Profile322.gsf", "d:/code_ws/Data/gpr/carpinis_travertine/Longitudinal/Profile323.gsf", "d:/code_ws/Data/gpr/carpinis_travertine/Longitudinal/Profile324.gsf", "d:/code_ws/Data/gpr/carpinis_travertine/Transversal/Profile298.gsf", "d:/code_ws/Data/gpr/carpinis_travertine/Transversal/Profile299.gsf", "d:/code_ws/Data/gpr/carpinis_travertine/Transversal/Profile300.gsf", "d:/code_ws/Data/gpr/carpinis_travertine/Transversal/Profile301.gsf", "d:/code_ws/Data/gpr/carpinis_travertine/Transversal/Profile302.gsf", "d:/code_ws/Data/gpr/carpinis_travertine/Transversal/Profile303.gsf", "d:/code_ws/Data/gpr/carpinis_travertine/Transversal/Profile304.gsf", "d:/code_ws/Data/gpr/carpinis_travertine/Transversal/Profile305.gsf", "d:/code_ws/Data/gpr/carpinis_travertine/Transversal/Profile306.gsf", "d:/code_ws/Data/gpr/carpinis_travertine/Transversal/Profile307.gsf", "d:/code_ws/Data/gpr/carpinis_travertine/Transversal/Profile308.gsf", "d:/code_ws/Data/gpr/carpinis_travertine/Transversal/Profile309.gsf", "d:/code_ws/Data/gpr/carpinis_travertine/Transversal/Profile310.gsf"],
    Preset="travertine_390",
    LineSpacing=0.5,
    Velocity=0.0831,
    EnergyQuantile=-1,
    MaxDip=-1,
    Migrate=True,
    Orientation=[0, 0, 0, 0, 0, 0, 0, 0, 0, 0, 0, 0, 0, 0, 1, 1, 1, 1, 1, 1, 1, 1, 1, 1, 1, 1, 1])  # -> FracturePicks, LineId, Confidence, Depths, EnergySections, BedrockDepth, Report
panel = Panel(gprgrid.Report)
preview = CustomPreview(Geometry=gprgrid.FracturePicks, Material=ColourSwatch(SwatchColor=RGB(235, 95, 30)))
preview_2 = CustomPreview(Geometry=gprgrid.EnergySections, Material=ColourSwatch(SwatchColor=RGB(120, 150, 210)))
gprfrac3d = GPRFractureSurfaces3D(
    FracturePicks=gprgrid.FracturePicks,
    NumFractures=-1,
    GridRes=36,
    Velocity=0.0831,
    Frequency=600,
    Eps_r=13.03,
    PermUncertainty=1,
    Tolerance=0.02,
    AssumeOpen=True,
    TimeZero=0,
    DetectBase=0.8,
    ThroughPicks=True,
    PickEnergy=gprgrid.Confidence,
    PeakDedup=True)  # -> FractureSurfaces, Confidence, MeanSigma, OverallConfidence, Report, Detectability, EffectiveConfidence
panel_2 = Panel(gprfrac3d.Report)
preview_3 = CustomPreview(Geometry=gprfrac3d.FractureSurfaces, Material=ColourSwatch(SwatchColor=RGB(70, 165, 95)))
bedslabs = FractureBoundedSlabs(
    Bench={Plane=PlaneXY(0, 0, 0), X=Domain(0, 6.1), Y=Domain(0, 6.9), Z=Domain(-3.3, 0.3)},
    BedSurfaces=gprfrac3d.FractureSurfaces,
    GridRes=26,
    KeepOut=0)  # -> Slabs, Thickness, Report
panel_3 = Panel(bedslabs.Report)
preview_4 = CustomPreview(Geometry=bedslabs.Slabs, Material=ColourSwatch(SwatchColor=RGB(225, 180, 110)))
fracblockpack = FractureBlockPack(
    ContainerMeshes=bedslabs.Slabs,
    BlockLength=0.9,
    BlockWidth=0.7,
    BlockHeight=0.4,
    Kerf=0.03,
    FractureClearance=0,
    Run=True,
    UncertaintySafe=False,
    Packer=5)  # -> Blocks, BinIndex, BlockCount, RecoveredVolume, Yield, Report
panel_4 = Panel(fracblockpack.Report)
preview_5 = CustomPreview(Geometry=fracblockpack.Blocks, Material=ColourSwatch(SwatchColor=RGB(90, 130, 165)))
