# Grasshopper definition wholeside_reassembly.gh (Grasshopper 1.0.8)
# plug-ins: Frahan StonePack

anchor = Curve(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)
parts = Curve([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])
run = BooleanToggle(True)
wsassemble = WholeSideAssemble(Anchor=anchor, Parts=parts, FitGate=2.5, Run=run)  # -> Placed, Transforms, Ids, TotalResidual, Report
series = Series(Start=0, Step=1, Count=[10, 9])
boundary = BoundarySurfaces(Edges=wsassemble.Placed)
gradient = Gradient(
    LowerLimit=[0, 0],
    UpperLimit=[1, 8],
    Parameter=series,
    stops=[0.0378: RGB(234, 38, 0), 0.244: RGB(234, 126, 0), 0.475: RGB(254, 244, 84), 0.75: RGB(173, 203, 249), 1: RGB(75, 107, 169)])
preview = CustomPreview(Geometry=boundary, Material=gradient)
preview_2 = CustomPreview(
    Geometry=anchor,
    Material=[{diffuse=RGB(221, 160, 221), emission=RGB(66, 48, 66), shine=0.5, specular=RGB(255, 255, 255), transparency=0}, {diffuse=RGB(60, 54, 48), emission=RGB(0, 0, 0), shine=0, specular=RGB(255, 255, 255), transparency=0}])
