# Grasshopper definition nbo_to_robot.gh (Grasshopper 1.0.8)
# plug-ins: Frahan StonePack

inventory = Mesh([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])
nbowall = DryStoneWallNBO(
    Inventory=inventory,
    WallLength=3,
    TargetHeight=1.6,
    CourseOffset=0.25,
    Gap=0.02,
    Confirm=False,
    CRA=False,
    Run=Toggle(True))  # -> Placed, Transforms, Course, Stable, Cost, Report
nborobot = NextBestObjectPoseRobotFrame(Stones=inventory, Placements=nbowall.Transforms, RobotBase=PlaneXY(0, 0, 0), Approach=0.15)  # -> PickFrames, PlaceFrames, ApproachFrames, PlacePoses, GripWidth, GripLength
