# Grasshopper definition kinematic_intensity_screen.gh (Grasshopper 1.0.8)
# plug-ins: Frahan StonePack

discin = DiscontinuityIngest(File="D:\frahan-stonepack\examples\31_discontinuity_ingest\survey_discontinuities.csv", Origin=Point(0, 0, 0))  # -> Planes, Traces, Dip, DipDir, SetId, Report
discin_2 = DiscontinuityIngest(File="D:\frahan-stonepack\docs\validation\discontinuity_ingest_card\tongjiang_sets.csv", Origin=Point(0, 0, 0))  # -> Planes, Traces, Dip, DipDir, SetId, Report
slope_dip = Slider(60, range=0..90)
slope_dipdir = Slider(323, range=0..360)
friction = Slider(30, range=0..60)
kinematic = KinematicFeasibility(
    Dip=discin_2.Dip,
    DipDir=discin_2.DipDir,
    SlopeDip=slope_dip,
    SlopeDipDir=slope_dipdir,
    Friction=friction,
    Lateral=20,
    Plane=PlaneXY(0, 0, 0),
    Radius=10)  # -> Planar, Wedge, Toppling, Feasible, SetPoles, Net, Report
terzaghi = TerzaghiCorrection(Dip=discin.Dip, DipDir=discin.DipDir, SetId=discin.SetId, Sampling=Vector(0, 0, 1), Window=False, MinAngle=15)  # -> Weight, BiasAngle, SetIds, RawFrac, CorrectedFrac, BlindZone, Report
intensity = FractureIntensity(Dip=discin_2.Dip, DipDir=discin_2.DipDir, Spacing=[1.3, 2.83, 1.94, 3.75, 2.45], UnitScale=1, Volume=0)  # -> P32PerSet, P32, P10, P30, Report
ibsd = InSituBlockSize(
    Dip=discin_2.Dip,
    DipDir=discin_2.DipDir,
    Spacing=[1.3, 2.83, 1.94, 3.75, 2.45],
    Scatter=10,
    Exponential=True,
    Realizations=2000,
    Seed=7,
    UnitScale=1)  # -> Volumes, P10, P50, P90, Deq, RightPrism, ShapeMix, Report
