# Grasshopper definition fabrication_handoff.gh (Grasshopper 1.0.8)
# plug-ins: Frahan StonePack

discin = DiscontinuityIngest(File="D:\frahan-stonepack\docs\validation\discontinuity_ingest_card\tongjiang_sets.csv", Origin=Point(0, 0, 0))  # -> Planes, Traces, Dip, DipDir, SetId, Report
cutopt = CutOrientation(Dip=discin.Dip, DipDir=discin.DipDir, Bench=True, Center=Point(0, 0, 0), Extent=5)  # -> CutPlanes, CutDip, CutDipDir, FollowsSet, Obliquity, MaxObliquity, Fit, CutRectangles, Report
blockyield = BlockYield(
    RawBlock=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,
    CutFrame=PlaneXY(0, 0, 0),
    TargetSize=Vector(0.5, 0.4, 0.3),
    Tolerance=0.1,
    Kerf=0.006,
    Fractures=[PlaneYZ(1.05, 0.65, 0.5), Plane(origin=(1.7, 1, 0.7), x=(-0.5144957554, 0.8574929257, 0), y=(-0.278207442, -0.1669244652, 0.9459053029))])  # -> Blocks, Flawed, Count, BlockSize, Yield, SoundYield, Report
wiresaw = WireSawFeasibility(Surface=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, WireDia=0.003, Vibration=0.0005, Tolerance=0.005, Samples=12)  # -> WireSawable, Ruled, Developable, Planar, MaxGaussian, RulingDev, Twist, Kerf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
dxfcut = DXFCutPlan(
    Curves=cutopt.CutRectangles,
    FlattenNest=True,
    Gap=0.1,
    SheetWidth=0,
    TextHeight=0,
    FilePath="D:\frahan-stonepack\examples\47_fabrication_handoff\cutplan.dxf",
    Write=False)  # -> FilePath, Count, Layout, Report
compas = COMPASExport(
    Blocks=blockyield.Blocks,
    Units="m",
    Loader=False,
    FilePath="D:\frahan-stonepack\examples\47_fabrication_handoff\assembly_compas.json",
    Write=False)  # -> FilePath, Loader, Blocks, Frames, Report
