# Grasshopper definition extraction_order_plan.gh (Grasshopper 1.0.8)
# plug-ins: Frahan StonePack

qinv = FrahanQuarryInventory(
    BenchId="BenchA",
    BlockBoxes=[{Plane=PlaneXY(0, 0, 0), X=Domain(0, 3), Y=Domain(0, 2), Z=Domain(0, 1.5)}, {Plane=PlaneXY(0, 0, 0), X=Domain(3.5, 6), Y=Domain(0, 2), Z=Domain(0, 1.5)}, {Plane=PlaneXY(0, 0, 0), X=Domain(6.5, 9.5), Y=Domain(0, 1.8), Z=Domain(0, 1.2)}, {Plane=PlaneXY(0, 0, 0), X=Domain(10, 12), Y=Domain(0, 2), Z=Domain(0, 1)}, {Plane=PlaneXY(0, 0, 0), X=Domain(12.5, 16), Y=Domain(0, 2), Z=Domain(0, 1.5)}, {Plane=PlaneXY(0, 0, 0), X=Domain(16.5, 19.3), Y=Domain(0, 1.5), Z=Domain(0, 1.2)}, {Plane=PlaneXY(0, 0, 0), X=Domain(19.8, 22.8), Y=Domain(0, 2.5), Z=Domain(0, 1.5)}, {Plane=PlaneXY(0, 0, 0), X=Domain(23.3, 25.5), Y=Domain(0, 2), Z=Domain(0, 1.3)}],
    BlockIds=["B1", "B2", "B3", "B4", "B5", "B6", "B7", "B8"],
    GeologyGrade=[0.8, 0.6, 0.9, 0.5, 0.7, 0.85, 0.6, 0.75],
    AccessCost=[0.2, 0.3, 0.1, 0.4, 0.25, 0.15, 0.35, 0.2])  # -> Inventory, Count, TotalVolumeM3, AvgGrade
qyield = FrahanQuarryYieldEstimator(
    Inventory=qinv.Inventory,
    Fractures=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,
    ProductXM=0.9,
    ProductYM=0.7,
    ProductZM=0.4,
    KerfM=0.03,
    PsiStepDeg=3,
    DxMax=0.5,
    DxStep=0.5,
    DyMax=0.5,
    DyStep=0.5,
    RiskNormaliser=50)  # -> Estimates, BlockIds, Recovery, FractureRisk, CuttingTimeMin
qorder = FrahanExtractionOrderOptimizer(
    Inventory=qinv.Inventory,
    Estimates=qyield.Estimates,
    YieldWeight=0.6,
    RiskWeight=0.2,
    AccessWeight=0.2,
    MinYield=0,
    AccessNormaliser=1)  # -> Plan, OrderIds, Scores, SkippedIds, TotalRecoverableM3, TotalWasteM3
qsched = FrahanSawBedSchedule(Plan=qorder.Plan, BedCount=2, SetupMin=0)  # -> Schedule, BedSummary, MakespanMin, SlotCount
qrep = FrahanQuarryReport(Inventory=qinv.Inventory, Plan=qorder.Plan, Schedule=qsched.Schedule)  # -> Report, Markdown, YieldM3, WasteM3, Recovery, MakespanMin
