# Grasshopper definition guell_formfind_v001.gh (Grasshopper 1.0.8)
# plug-ins: Frahan StonePack

edge_length = Slider(0.7, range=0.3..1.5)
bnet = BoundaryNet(Boundary=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, EdgeLength=edge_length)  # -> Net, Anchors, Report
force_density_q = Slider(1, range=0.2..6)
load = Slider(-1.5, range=-4..-0.1)
invert = BooleanToggle(True)
relax = CatenaryRelax(Net=bnet.Net, Anchors=bnet.Anchors, ForceDensity=force_density_q, Load=load, Invert=invert, AnchorTol=0.05)  # -> Form, Rise, Report
subd_density = Slider(2, range=1..4)
subdv = SubDVault(Control=relax.Form, Density=subd_density)  # -> Smooth, Report
