# Grasshopper definition guell_quadrubble_v002.gh (Grasshopper 1.0.8)
# plug-ins: Frahan StonePack

support_band = Slider(0.3, range=0.05..0.6)
smooth = Slider(30, range=0..100)
coarseness = Slider(2, range=1..8)
run_remesh = BooleanToggle(True)
thrustquad = ThrustQuadRemeshQuadWild(
    Mesh=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,
    ThrustField=True,
    SupportBand=support_band,
    Smooth=smooth,
    Coarseness=coarseness,
    Run=run_remesh)  # -> QuadMesh, Report
shrink = Slider(0.92, range=0.7..1)
col_z_lo = Slider(0.9, range=0..3)
col_z_hi = Slider(1.8, range=0.1..4)
col_split = Slider(2, range=1..4)
tube_angle = Slider(12, range=2..40)
quadcells = QuadCells(
    QuadMesh=thrustquad.QuadMesh,
    Shrink=shrink,
    ColumnZLo=col_z_lo,
    ColumnZHi=col_z_hi,
    ColumnSplit=col_split,
    TubeAngle=tube_angle)  # -> Cells, Frames, Columnness, Report, InnerLimit
d_vault = Slider(0.26, range=0.05..0.5)
d_column = Slider(0.18, range=0.05..0.5)
protrude = Slider(0.04, range=0..0.15)
run_moulds = BooleanToggle(True)
vaultmould = VaultVoussoirMoulds(
    Cells=quadcells.Cells,
    Frames=quadcells.Frames,
    Columnness=quadcells.Columnness,
    DVault=d_vault,
    DColumn=d_column,
    Protrude=protrude,
    Run=run_moulds,
    InnerLimit=quadcells.InnerLimit)  # -> Moulds, Cells, Frames, Columnness, Report
seed = Slider(18, range=1..99)
overfill = Slider(1.16, range=1..1.5)
pool_ar = Slider(2.2, range=1.2..4)
run_fit = BooleanToggle(True)
vaultstone = VaultStoneFitTrim(
    Moulds=vaultmould.Moulds,
    Cells=vaultmould.Cells,
    Frames=vaultmould.Frames,
    Columnness=vaultmould.Columnness,
    DVault=d_vault,
    DColumn=d_column,
    ETHDir="D:\code_ws\Data\eth1100\closed\1100 Closed Stone Meshes",
    Seed=seed,
    Overfill=overfill,
    PoolAR=pool_ar,
    Run=run_fit,
    Match=False)  # -> Rubble, Report
preview = CustomPreview(
    Geometry=vaultstone.Rubble,
    Material=[{diffuse=RGB(221, 160, 221), emission=RGB(66, 48, 66), shine=0.5, specular=RGB(255, 255, 255), transparency=0}, {diffuse=RGB(189, 166, 135), emission=RGB(0, 0, 0), shine=0, specular=RGB(255, 255, 255), transparency=0}])
