# Grasshopper definition guell_quadstructure_v001.gh (Grasshopper 1.0.8)
# plug-ins: Frahan StonePack

support_band = Slider(0.3, range=0.05..0.6)
smooth = Slider(30, range=0..100)
coarseness_structural = Slider(5, range=1..8)
run = BooleanToggle(True)
thrustquad = ThrustQuadRemeshQuadWild(
    Mesh=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,
    ThrustField=True,
    SupportBand=support_band,
    Smooth=smooth,
    Coarseness=coarseness_structural,
    Run=run)  # -> QuadMesh, Report
