# Grasshopper definition three_prong_formfind_v001.gh (Grasshopper 1.0.8)
# plug-ins: Frahan StonePack

edge_length = Slider(0.35, range=0.15..1)
bnet = BoundaryNet(Boundary=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, EdgeLength=edge_length)  # -> Net, Anchors, Report
force_density_q = Slider(1, range=0.2..6)
load = Slider(-1, range=-4..-0.1)
relax = CatenaryRelax(Net=bnet.Net, Anchors=bnet.Anchors, ForceDensity=force_density_q, Load=load, Invert=True, AnchorTol=0.05)  # -> Form, Rise, Report
subd_density = Slider(2, range=1..4)
subdv = SubDVault(Control=relax.Form, Density=subd_density)  # -> Smooth, Report
length_factor = Slider(1.2, range=1.01..1.8)
catenary = CatenaryCurve(PointA=Point(-2.3, 0, 0), PointB=Point(2.3, 0, 0), LengthFactor=length_factor, Segments=24, Invert=False)  # -> Curve, Sag
