# Grasshopper definition three_prong_staggered_cra_v002.gh (Grasshopper 1.0.8)
# plug-ins: Frahan StonePack

support_band = Slider(0.3, range=0.05..0.6)
smooth = Slider(30, range=0..100)
coarseness = Slider(4, range=1..8)
run_remesh = BooleanToggle(True)
thrustquad = ThrustQuadRemeshQuadWild(
    Mesh=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,
    ThrustField=True,
    SupportBand=support_band,
    Smooth=smooth,
    Coarseness=coarseness,
    Run=run_remesh)  # -> QuadMesh, Report
edge_0_as_is = Slider(0, range=0..1)
thickness = Slider(0.15, range=0.05..0.5)
min_block = Slider(0.45, range=0.2..1)
hub_mode_0_1_2 = Slider(1, range=0..2)
run_cra = BooleanToggle(True)
stagger = BooleanToggle(True)
shellcra = VaultShellCRA(
    Shell=thrustquad.QuadMesh,
    EdgeLength=edge_0_as_is,
    Thickness=thickness,
    Friction=0.84,
    Density=2400,
    SupportBand=0.08,
    Run=run_cra,
    Stagger=stagger,
    MinBlock=min_block,
    HubMode=hub_mode_0_1_2)  # -> Blocks, Coverage, Interfaces, Stable, Report
preview = CustomPreview(
    Geometry=shellcra.Blocks,
    Material=[{diffuse=RGB(221, 160, 221), emission=RGB(66, 48, 66), shine=0.5, specular=RGB(255, 255, 255), transparency=0}, {diffuse=RGB(96, 155, 106), emission=RGB(0, 0, 0), shine=0, specular=RGB(255, 255, 255), transparency=0}])
preview_2 = CustomPreview(
    Geometry=shellcra.Stable,
    Material=[{diffuse=RGB(221, 160, 221), emission=RGB(66, 48, 66), shine=0.5, specular=RGB(255, 255, 255), transparency=0}, {diffuse=RGB(78, 110, 168), emission=RGB(0, 0, 0), shine=0, specular=RGB(255, 255, 255), transparency=0}])  # disabled
